# Grasshopper definition 03-coordenadas-cilindricas.gh (Grasshopper 1.0.8)

r = Slider(21.93, range=0..50)
a = Slider(125.314, range=0..360)
e = Slider(21.97, range=-50..50)
margin = Number(Slider(1, range=0..5))
offset = Number(Slider(3, range=-5..5))
rad = Radians(Degrees=a)
origin = Point(Point(0, 0, 0))
e_2 = Number(e)
r_2 = Number(r)
a_2 = Number(rad)

r_3 = Number(r_2)
a_3 = Number(a_2)
origin_2 = Point(Point(0, 0, 0))
pt = PointCylindrical(BasePlane=PlaneXY(0, 0, 0), Angle=0, Radius=r_3, Elevation=0)
pt_2 = PointCylindrical(BasePlane=PlaneXY(0, 0, 0), Angle=a_3, Radius=r_3, Elevation=0)
angledim = AngularDimension(Center=origin_2, PointA=pt, PointB=pt_2, Reflex=False, Text="a = {0:0.0}°", Size=1)

a_4 = Number(a_2)
e_3 = Number(e_2)
r_4 = Number(r_2)
pt_3 = PointCylindrical(BasePlane=PlaneXY(0, 0, 0), Angle=a_4, Radius=r_4, Elevation=0)
pt_4 = PointCylindrical(BasePlane=PlaneXY(0, 0, 0), Angle=a_4, Radius=r_4, Elevation=e_3)
ln = Line(StartPoint=pt_3, EndPoint=pt_4)
elevation_line = Line(ln)

a_5 = Number(a_2)
e_4 = Number(e_2)
r_5 = Number(r_2)
pt_5 = PointCylindrical(BasePlane=PlaneXY(0, 0, 0), Angle=a_5, Radius=r_5, Elevation=e_4)
dots = DotDisplay(Point=pt_5, Colour=RGB(13, 255, 0), Size=0.3)

xy = XYPlane(Origin=Point(0, 0, 0))
a_6 = Number(a_2)
prot = RotatePlane(Plane=xy, Angle=a_6)
margin_2 = Number(margin)
deplane = DeconstructPlane(Plane=prot)  # -> Origin, XAxis, YAxis, ZAxis
amp = Amplitude(Vector=deplane.YAxis, Amplitude=margin_2)
move = Move(Motion=amp)  # -> Geometry, Transform
r_6 = Number(r_2)
a_7 = Number(a_2)
origin_3 = Point(Point(0, 0, 0))
pt_6 = PointCylindrical(BasePlane=PlaneXY(0, 0, 0), Angle=a_7, Radius=r_6, Elevation=0)
transform = Transform(Geometry=origin_3, Transform=move.Transform)
transform_2 = Transform(Geometry=pt_6, Transform=move.Transform)
offset_2 = Number(offset)
aligndim = AlignedDimension(Plane=prot, PointA=transform, PointB=transform_2, Offset=offset_2, Text="r = {0:0.00}", Size=1)

a_8 = Number(a_2)
r_7 = Number(r_2)
pt_7 = PointCylindrical(BasePlane=PlaneXY(0, 0, 0), Angle=a_8, Radius=r_7, Elevation=0)
origin_4 = Point(Point(0, 0, 0))
ln_2 = Line(StartPoint=origin_4, EndPoint=pt_7)
radius_line = Line(ln_2)

a_9 = Number(a_2)
margin_3 = Number(margin)
e_5 = Number(e_2)
r_8 = Number(r_2)
xz = XZPlane(Origin=Point(0, 0, 0))
a_10 = Number(a_2)
addition = Addition(A=margin_3, B=r_8)
rotate = Rotate(Geometry=xz, Angle=a_10, Plane=PlaneXY(0, 0, 0))  # -> Geometry, Transform
pt_8 = PointCylindrical(BasePlane=PlaneXY(0, 0, 0), Angle=a_9, Radius=addition, Elevation=e_5)
pt_9 = PointCylindrical(BasePlane=PlaneXY(0, 0, 0), Angle=a_9, Radius=addition, Elevation=0)
offset_3 = Number(offset)
aligndim_2 = AlignedDimension(Plane=rotate.Geometry, PointA=pt_9, PointB=pt_8, Offset=expr("-x", offset_3), Text="e = {0:0.00}", Size=1)

panel = Panel("""0.5
0.5""")
linetype = ModelLinetype(Name="Line", Segments=panel, CapStyle=0, JoinStyle=0, Width=1, WidthUnits=0)  # -> ModelLinetype, Name, Segments, CapStyle, JoinStyle, Width, WidthUnits
linetype_2 = Linetype(linetype.ModelLinetype)

elevation_line_2 = Line(elevation_line)
linetype_3 = Linetype(linetype_2)
radius_line_2 = Line(radius_line)
linetype_4 = Linetype(linetype_2)
curve_preview = CustomCurvePreview(Curve=elevation_line_2, Linetype=linetype_3, Colour=RGB(255, 255, 255))
curve_preview_2 = CustomCurvePreview(Curve=radius_line_2, Linetype=linetype_4, Colour=RGB(255, 255, 255))
