# Grasshopper definition ejercicio-puntos-02.gh (Grasshopper 1.0.8)

# 2. Dadas las coordenadas polares, crear un punto
number_slider = Slider(4.624, range=0..20)
distancia = Number(number_slider)
ángulo_xy = Number(Slider(97.2, range=0..360))
ángulo_z = Number(Slider(41.4, range=-90..90))
punto = Point()
panel = Panel(punto)
