# Grasshopper definition ejercicio-puntos-04.gh (Grasshopper 1.0.8)

pt = Point(Point(-11.1065416, 11.32789555, 9.713576209))
pt_2 = Point(Point(6.730445199, 4.939485699, 3.838469858))
punto_b = Point(pt_2)
# Dados dos puntos, obtener la distancia entre ambos
punto_a = Point(pt)
distancia = Number()
panel = Panel(distancia)
