# Grasshopper definition ejercicio-puntos-05.gh (Grasshopper 1.0.8)

crv = Curve(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)
# 5. Dada una curva, obtener su punto medio
curva = Curve(crv)
punto_medio = Point()
panel = Panel(punto_medio)
