# Grasshopper definition ejercicio-puntos-06.gh (Grasshopper 1.0.8)

crv = Curve(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)
# 6. Dada una curva no cerrada, obtener sus extremos
curva = Curve(crv)
inicio = Point()
final = Point()
panel = Panel(inicio)
panel_2 = Panel(final)
