# Grasshopper definition ejercicio-puntos-07.gh (Grasshopper 1.0.8)

# Dado un punto, obtener sus coordenadas cartesianas
pt = Point(Point(12.01316014, 18.52158717, 2.818158552))
punto = Point(pt)
y = Number()
z = Number()
x = Number()
panel = Panel(y)
panel_2 = Panel(z)
panel_3 = Panel(x)
