# Grasshopper definition ejercicio-puntos-08.gh (Grasshopper 1.0.8)

# 8. Dado un punto y una distancia,
# crear otro punto ubicado a esa distancia del punto en la dirección de Y
pt = Point(Point(8.801908689, 23.61147212, 0))
punto = Point(pt)
distancia = Number(Slider(19.2, range=-20..20))
punto_2 = Point()
panel = Panel(punto_2)
