# Grasshopper definition 01-coordenadas-cartesianas.gh (Grasshopper 1.0.8)

x = Slider(23.657, range=-50..50)
y = Slider(21.241, range=-50..50)
z = Slider(11.882, range=-50..50)
margin = Number(Slider(1, range=0..5))
offset = Number(Slider(-3, range=-5..5))
y_2 = Number(y)
x_2 = Number(x)
z_2 = Number(z)

y_3 = Number(y)
margin_2 = Number(margin)
x_3 = Number(x)
z_3 = Number(z)
addition = Addition(A=x_3, B=margin_2)
xz = XZPlane(Origin=Point(0, 0, 0))
pl_offset = PlaneOffset(BasePlane=xz, Offset=expr("-x", y_3))
pt = ConstructPoint(XCoordinate=addition, YCoordinate=y_3, ZCoordinate=0)
pt_2 = ConstructPoint(XCoordinate=addition, YCoordinate=y_3, ZCoordinate=z_3)
offset_2 = Number(offset)
aligndim = AlignedDimension(Plane=pl_offset, PointA=pt, PointB=pt_2, Offset=offset_2, Text="z = {0:0.00}", Size=1)

x_4 = Number(x)
margin_3 = Number(margin)
y_4 = Number(y)
addition_2 = Addition(A=x_4, B=margin_3)
pt_3 = ConstructPoint(XCoordinate=addition_2, YCoordinate=y_4, ZCoordinate=0)
pt_4 = ConstructPoint(XCoordinate=addition_2, YCoordinate=0, ZCoordinate=0)
offset_3 = Number(offset)
aligndim_2 = AlignedDimension(Plane=PlaneXY(0, 0, 0), PointA=pt_4, PointB=pt_3, Offset=offset_3, Text="y = {0:0.00}", Size=1)

margin_4 = Number(margin)
y_5 = Number(y)
x_5 = Number(x)
addition_3 = Addition(A=y_5, B=margin_4)
pt_5 = ConstructPoint(XCoordinate=0, YCoordinate=addition_3, ZCoordinate=0)
pt_6 = ConstructPoint(XCoordinate=x_5, YCoordinate=addition_3, ZCoordinate=0)
offset_4 = Number(offset)
aligndim_3 = AlignedDimension(Plane=PlaneXY(0, 0, 0), PointA=pt_5, PointB=pt_6, Offset=expr("-x", offset_4), Text="x = {0:0.00}", Size=1)

pt_7 = ConstructPoint(XCoordinate=x, YCoordinate=y, ZCoordinate=z)
dots = DotDisplay(Point=pt_7, Colour=RGB(13, 255, 0), Size=0.3)

panel = Panel("""0.5
0.5""")
linetype = ModelLinetype(Name="Line", Segments=panel, CapStyle=0, JoinStyle=0, Width=1, WidthUnits={BaseSystem=0, Name="Pixels"})  # -> ModelLinetype, Name, Segments, CapStyle, JoinStyle, Width, WidthUnits
linetype_2 = Linetype(linetype.ModelLinetype)

z_4 = Number(z)
x_6 = Number(x)
y_6 = Number(y)
pt_8 = ConstructPoint(XCoordinate=x_6, YCoordinate=y_6, ZCoordinate=0)
pt_9 = ConstructPoint(XCoordinate=x_6, YCoordinate=y_6, ZCoordinate=z_4)
ln = Line(StartPoint=pt_8, EndPoint=pt_9)
linetype_3 = Linetype(linetype_2)
curve_preview = CustomCurvePreview(Curve=ln, Linetype=linetype_3, Colour=RGB(255, 255, 255))
