# Grasshopper definition 02-coordenadas-polares.gh (Grasshopper 1.0.8)

d = Slider(20.191, range=-50..50)
z = Slider(43.801, range=-180..180)
xy = Slider(70.037, range=0..360)
offset = Number(Slider(-3, range=-5..5))
rad = Radians(Degrees=xy)
rad_2 = Radians(Degrees=z)
origin = Point(Point(0, 0, 0))
d_2 = Number(d)
xy_2 = Number(rad)
z_2 = Number(rad_2)

d_3 = Number(d)
xy_3 = Number(xy_2)
z_3 = Number(z_2)
pt = PointPolar(BasePlane=PlaneXY(0, 0, 0), XYAngle=xy_3, ZAngle=z_3, Offset=d_3)
dots = DotDisplay(Point=pt, Colour=RGB(13, 255, 0), Size=0.3)

d_4 = Number(d)
z_4 = Number(z_2)
xy_4 = Number(xy_2)
pt_2 = PointPolar(BasePlane=PlaneXY(0, 0, 0), XYAngle=xy_4, ZAngle=z_4, Offset=d_4)
project = Project(Geometry=pt_2, Plane=PlaneXY(0, 0, 0))  # -> Geometry, Transform
origin_2 = Point(Point(0, 0, 0))
ln = Line(StartPoint=origin_2, EndPoint=project.Geometry)
line_projection = Line(ln)

z_5 = Number(z_2)
d_5 = Number(d)
xy_5 = Number(xy_2)
xz = XZPlane(Origin=Point(0, 0, 0))
pt_3 = PointPolar(BasePlane=PlaneXY(0, 0, 0), XYAngle=xy_5, ZAngle=z_5, Offset=d_5)
rotate = Rotate(Geometry=xz, Angle=xy_5, Plane=PlaneXY(0, 0, 0))  # -> Geometry, Transform
offset_2 = Number(offset)
origin_3 = Point(Point(0, 0, 0))
aligndim = AlignedDimension(Plane=rotate.Geometry, PointA=origin_3, PointB=pt_3, Offset=expr("-x", offset_2), Text="d = {0:0.00}", Size=1)

d_6 = Number(d)
z_6 = Number(z_2)
xy_6 = Number(xy_2)
origin_4 = Point(Point(0, 0, 0))
pt_4 = PointPolar(BasePlane=PlaneXY(0, 0, 0), XYAngle=0, ZAngle=0, Offset=d_6)
pt_5 = PointPolar(BasePlane=PlaneXY(0, 0, 0), XYAngle=xy_6, ZAngle=0, Offset=d_6)
angledim = AngularDimension(Center=origin_4, PointA=pt_4, PointB=pt_5, Reflex=False, Text="xy = {0:0.0}°", Size=1)

d_7 = Number(d)
z_7 = Number(z_2)
xy_7 = Number(xy_2)
pt_6 = PointPolar(BasePlane=PlaneXY(0, 0, 0), XYAngle=xy_7, ZAngle=z_7, Offset=d_7)
pt_7 = PointPolar(BasePlane=PlaneXY(0, 0, 0), XYAngle=xy_7, ZAngle=0, Offset=d_7)
origin_5 = Point(Point(0, 0, 0))
angledim_2 = AngularDimension(Center=origin_5, PointA=pt_7, PointB=pt_6, Reflex=False, Text="z = {0:0.0}°", Size=1)

d_8 = Number(d)
z_8 = Number(z_2)
xy_8 = Number(xy_2)
pt_8 = PointPolar(BasePlane=PlaneXY(0, 0, 0), XYAngle=xy_8, ZAngle=z_8, Offset=d_8)
origin_6 = Point(Point(0, 0, 0))
ln_2 = Line(StartPoint=origin_6, EndPoint=pt_8)
line_to_point = Line(ln_2)

panel = Panel("""0.5
0.5""")
linetype = ModelLinetype(Name="Line", Segments=panel, CapStyle=0, JoinStyle=0, Width=1, WidthUnits=0)  # -> ModelLinetype, Name, Segments, CapStyle, JoinStyle, Width, WidthUnits
linetype_2 = Linetype(linetype.ModelLinetype)

line_to_point_2 = Line(ln_2)
line_projection_2 = Line(line_projection)
linetype_3 = Linetype(linetype_2)
linetype_4 = Linetype(linetype_2)
curve_preview = CustomCurvePreview(Curve=line_to_point_2, Linetype=linetype_3, Colour=RGB(255, 255, 255))
curve_preview_2 = CustomCurvePreview(Curve=line_projection_2, Linetype=linetype_4, Colour=RGB(255, 255, 255))
