# Grasshopper definition ejercicio-puntos-01.gh (Grasshopper 1.0.8)

# 1. Dadas las coordenadas cartesianas, crear un punto
number_slider = Slider(0.25, range=-20..20)
x = Number(number_slider)
y = Number(Slider(3.8, range=-20..20))
z = Number(Slider(9.02, range=-20..20))
punto = Point()
panel = Panel(punto)
