# Grasshopper definition ejercicio-puntos-03.gh (Grasshopper 1.0.8)

elevación = Number(Slider(1.62, range=-30..30))
ángulo = Number(Slider(0, range=0..360))
# 3. Dadas las coordenadas cilíndricas, crear un punto
radio = Number(Slider(0, range=0..20))
punto = Point()
panel = Panel(punto)
