# Grasshopper definition ejercicio-puntos-09.gh (Grasshopper 1.0.8)

# 9. Dada una curva no cerrada,
# obtener la diferencia entre las coordenadas y
crv = Curve(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)
curva = Curve(crv)
diferencia_entre_coordenadas_y_de_extrem = Number()  # "diferencia entre coordenadas y de extremos"
panel = Panel(diferencia_entre_coordenadas_y_de_extrem)
