# Grasshopper definition ejercicio-puntos-10.gh (Grasshopper 1.0.8)

# 10. Dado un punto,
# crear un punto que corresponda a su reflejo respecto al eje x.
pt = Point(Point(10.89884446, 18.46283983, 0))
punto = Point(pt)
punto_2 = Point()
panel = Panel(punto_2)
