# Grasshopper definition ejercicio-puntos-11.gh (Grasshopper 1.0.8)

# 11. Dada una curva cerrada y un punto,
# verificar si el punto está dentro de la curva.
crv = Curve(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)
pt = Point(Point(27.70440447, -0.04986897158, 0))
punto = Point(pt)
curva = Curve(crv)
está_adentro = Boolean()
panel = Panel(está_adentro)
