# Grasshopper definition 02-vectores.gh (Grasshopper 1.0.8)

x = Slider(-6.141, range=-20..20)
y = Slider(3.772, range=-20..20)
z = Slider(8.689, range=-20..20)
number_slider = Slider(50, range=0..50)
box = CenterBox(Base=PlaneXY(0, 0, 0), X=number_slider, Y=number_slider, Z=number_slider)
z_2 = Number(z)
x_2 = Number(x)
y_2 = Number(y)
pop3d = Populate3D(Region=box, Count=Slider(30, range=1..100), Seed=1)
z_3 = Number(z_2)
x_3 = Number(x_2)
y_3 = Number(y_2)
vec = VectorXYZ(XComponent=x_3, YComponent=y_3, ZComponent=z_3)  # -> Vector, Length
origen = Point(Point(0, 0, 0))
dist = Distance(PointA=pop3d, PointB=origen)
bnd = Bounds(Numbers=dist)
dedomain = DeconstructDomain(Domain=bnd)  # -> Start, End
gradient = Gradient(
    LowerLimit=dedomain.Start,
    UpperLimit=dedomain.End,
    Parameter=dist,
    stops=[0: RGB(243, 57, 0), 0.1: RGB(236, 27, 60), 0.2: RGB(210, 0, 118), 0.3: RGB(103, 0, 120), 0.4: RGB(39, 72, 161), 0.5: RGB(1, 192, 229), 0.6: RGB(18, 178, 90), 0.7: RGB(79, 186, 8), 0.8: RGB(220, 237, 32), 0.9: RGB(247, 159, 20), 1: RGB(243, 57, 0)])
vdisex = VectorDisplayEx(Point=pop3d, Vector=vec.Vector, Colour=gradient, Width=2)
