# Grasshopper definition 03-suma-vectores.gh (Grasshopper 1.0.8)

x1 = Slider(9.38, range=-20..20)
y1 = Slider(-5.431, range=-20..20)
z1 = Slider(17.212, range=-20..20)
x2 = Slider(12.56, range=-20..20)
y2 = Slider(12.961, range=-20..20)
z2 = Slider(10.375, range=-20..20)
z1_2 = Number(z1)
x1_2 = Number(x1)
z2_2 = Number(z2)
x2_2 = Number(x2)
y1_2 = Number(y1)
y2_2 = Number(y2)

z1_3 = Number(z1_2)
x1_3 = Number(x1_2)
y1_3 = Number(y1_2)
pt = ConstructPoint(XCoordinate=x1_3, YCoordinate=y1_3, ZCoordinate=z1_3)
origen_vector_2 = Point(pt)

z2_3 = Number(z2_2)
x2_3 = Number(x2_2)
y2_3 = Number(y2_2)
vec = VectorXYZ(XComponent=x2_3, YComponent=y2_3, ZComponent=z2_3)  # -> Vector, Length
vector_2 = Vector(vec.Vector)

z1_4 = Number(z1_2)
x1_4 = Number(x1_2)
y1_4 = Number(y1_2)
vec_2 = VectorXYZ(XComponent=x1_4, YComponent=y1_4, ZComponent=z1_4)  # -> Vector, Length
vector_1 = Vector(vec_2.Vector)

vector_1_2 = Vector(vector_1)
vector_2_2 = Vector(vector_2)
addition = Addition(A=vector_1_2, B=vector_2_2)
vector_2_3 = Vector(addition)

origen = Point(Point(0, 0, 0))
origen_vector_3 = Point(origen)

origen_2 = Point(Point(0, 0, 0))
origen_vector_1 = Point(origen_2)

vdisex = VectorDisplayEx(Point=origen_vector_2, Vector=vector_2, Colour=RGB(0, 255, 229), Width=2)
vdisex_2 = VectorDisplayEx(Point=origen_vector_3, Vector=vector_2_3, Colour=RGB(255, 229, 0), Width=2)
vdisex_3 = VectorDisplayEx(Point=origen_vector_1, Vector=vector_1, Colour=RGB(242, 0, 255), Width=2)
