# Grasshopper definition 04-multiplicacion-escalar.gh (Grasshopper 1.0.8)

multiplicador = Slider(-1.079, range=-5..5)
x = Slider(10.772, range=-20..20)
y = Slider(7.53, range=-20..20)
z = Slider(5.974, range=-20..20)
z_2 = Number(z)
x_2 = Number(x)
y_2 = Number(y)
z_3 = Number(z_2)
x_3 = Number(x_2)
y_3 = Number(y_2)
multiplicador_2 = Number(multiplicador)
vec = VectorXYZ(XComponent=x_3, YComponent=y_3, ZComponent=z_3)  # -> Vector, Length
multiplication = Multiplication(A=vec.Vector, B=multiplicador_2)
origen = Point(Point(0, 0, 0))
vdisex = VectorDisplayEx(Point=origen, Vector=vec.Vector, Colour=RGB(0, 242, 255), Width=2)
vdisex_2 = VectorDisplayEx(Point=origen, Vector=multiplication, Colour=RGB(51, 0, 255), Width=2)
