# Grasshopper definition 06-perpendicular.gh (Grasshopper 1.0.8)

x1 = Slider(-2.044, range=-20..20)
y1 = Slider(-1.619, range=-20..20)
z1 = Slider(2.424, range=-20..20)
x2 = Slider(2.384, range=-20..20)
y2 = Slider(-3.386, range=-20..20)
z2 = Slider(-0.62, range=-20..20)
z1_2 = Number(z1)
x1_2 = Number(x1)
z2_2 = Number(z2)
x2_2 = Number(x2)
y1_2 = Number(y1)
y2_2 = Number(y2)
x2_3 = Number(x2_2)
z2_3 = Number(z2_2)
y2_3 = Number(y2_2)
z1_3 = Number(z1_2)
x1_3 = Number(x1_2)
y1_3 = Number(y1_2)
vec = VectorXYZ(XComponent=x2_3, YComponent=y2_3, ZComponent=z2_3)  # -> Vector, Length
vec_2 = VectorXYZ(XComponent=x1_3, YComponent=y1_3, ZComponent=z1_3)  # -> Vector, Length
origen = Point(Point(0, 0, 0))
origen_2 = Point(Point(0, 0, 0))
xprod = CrossProduct(VectorA=vec_2.Vector, VectorB=vec.Vector, Unitize=False)  # -> Vector, Length
origen_3 = Point(Point(0, 0, 0))
vdisex = VectorDisplayEx(Point=origen, Vector=vec_2.Vector, Colour=RGB(242, 0, 255), Width=2)
vdisex_2 = VectorDisplayEx(Point=origen_2, Vector=vec.Vector, Colour=RGB(0, 229, 255), Width=2)
vdisex_3 = VectorDisplayEx(Point=origen_3, Vector=xprod.Vector, Colour=RGB(255, 255, 255), Width=2)
