# Grasshopper definition ejercicio-vectores-01.gh (Grasshopper 1.0.8)

# 1. Dadas las componentes X, Y y Z de un vector, crear un vector
number_slider = Slider(0.25, range=-20..20)
x = Number(number_slider)
y = Number(Slider(3.8, range=-20..20))
z = Number(Slider(9.02, range=-20..20))
vector = Vector()
panel = Panel(vector)
