# Grasshopper definition ejercicio-vectores-02.gh (Grasshopper 1.0.8)

# 2. Dado un vector, crear el vector opuesto
number_slider = Slider(0.25, range=-20..20)
x = Number(number_slider)
y = Number(Slider(3.8, range=-20..20))
z = Number(Slider(9.02, range=-20..20))
vector = Vector()
panel = Panel(vector)
