# Grasshopper definition ejercicio-vectores-03.gh (Grasshopper 1.0.8)

# 3. Dado un vector, obtener su longitud
vector = Vector(Vector(9.097356401, 0, 11.54968726))
vector_2 = Vector(vector)
panel = Panel(vector_2)
longitud = Number()
panel_2 = Panel(longitud)
