# Grasshopper definition ejercicio-vectores-06.gh (Grasshopper 1.0.8)

# 6. Dados dos vectores, obtener un vector perpendicular a ambos
vector_1 = Vector(Vector(14.4660476, -16.26200832, 0))
vector_2 = Vector(Vector(0, -12.89451386, 11.94522449))
vector_1_2 = Vector(vector_1)
vector_2_2 = Vector(vector_2)
vector_perpendicular = Vector()
panel = Panel(vector_perpendicular)
