# Grasshopper definition ejercicio-vectores-07.gh (Grasshopper 1.0.8)

# 7. Dado un punto y una distancia,
# mover el punto a dicha distancia en la dirección X
punto = Point(Point(16.20701357, 31.78233963, 0))
punto_2 = Point(punto)
distancia = Number(Slider(-30, range=-30..30))
punto_movido = Point()
panel = Panel(punto_movido)
