# Grasshopper definition ejercicio-vectores-08.gh (Grasshopper 1.0.8)

# 8. Dado un vector y una longitud,
# crear un vector con la misma dirección
# pero con la longitud proporcionada.
vector = Vector(Vector(-15.42876016, 20.16814058, 0))
vector_2 = Vector(vector)
longitud = Number(Slider(-20, range=-20..20))
vector_3 = Vector()
panel = Panel(vector_3)
