# Grasshopper definition ejercicio-vectores-09.gh (Grasshopper 1.0.8)

# 9. Dado un vector y una curva,
# extruir la curva a lo largo del vector.
curva = Curve(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)
vector = Vector(Vector(0, 5.2210915, 13.05272875))
curva_2 = Curve(curva)
vector_2 = Vector(vector)
superficie = Surface()
panel = Panel(superficie)
