# Grasshopper definition 02-planos-de-construccion.gh (Grasshopper 1.0.8)

radio = Slider(13.904, range=0..20)
plano_2 = Plane(Plane(origin=(19.68689709, 14.46839652, 0), x=(0.9430781817, -0.3325711101, 0), y=(-0.08200190946, -0.2325343643, -0.9691250984)))
plano_1 = Plane(Plane(origin=(0, -13.92291067, 10.83772023), x=(0.454484394, 0.8447273575, -0.2826298411), y=(-0.8362602843, 0.5139087589, 0.1912237547)))
radio_2 = Number(radio)
plano_1_2 = Plane(plano_1)
plano_2_2 = Plane(plano_2)
xy = XYPlane(Origin=Point(0, 0, 0))
cir = Circle(Plane=xy, Radius=radio_2)
cir_2 = Circle(Plane=plano_1_2, Radius=radio_2)
cir_3 = Circle(Plane=plano_2_2, Radius=radio_2)
