# Grasshopper definition 04-proyectar.gh (Grasshopper 1.0.8)

z = Slider(59.307, range=0..180)
xy = Slider(254.598, range=0..360)
x = Slider(8.746, range=-50..50)
y = Slider(23.267, range=-50..50)
z_2 = Slider(-9.88, range=-50..50)
curva = Curve(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)
puntos = Point([Point(-36.33857016, 21.00343116, 33.93026784), Point(-51.27986309, -12.46955084, 42.90171899), Point(-57.73142688, 21.87258463, 57.51807369), Point(-38.34544224, 20.49014773, 63.17019082), Point(-45.18809109, -11.32924466, 57.36657283), Point(-65.29528491, -16.86221456, 34.92623685)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])
z_3 = Number(z)
xy_2 = Number(xy)
x_2 = Number(x)
y_2 = Number(y)
z_4 = Number(z_2)
z_5 = Number(z_3)
xy_3 = Number(xy_2)
x_3 = Number(x_2)
z_6 = Number(z_4)
y_3 = Number(y_2)
pt = ConstructPoint(XCoordinate=x_3, YCoordinate=y_3, ZCoordinate=z_6)
pt_2 = PointPolar(BasePlane=PlaneXY(0, 0, 0), XYAngle=degrees(xy_3), ZAngle=expr("90-x", degrees(z_5)), Offset=1)
origen = Point(pt)
normal = Vector(pt_2)
normal_2 = Vector(normal)
origen_2 = Point(origen)
pl = PlaneNormal(Origin=origen_2, ZAxis=normal_2)
xy_4 = XYPlane(Origin=Point(0, 0, 0))
plano = Plane(pl)
puntos_2 = Point(puntos)
curva_2 = Curve(curva)
plano_2 = Plane(plano)
plano_3 = Plane(plano)
project = Project(Geometry=curva_2, Plane=plano_2)  # -> Geometry, Transform
project_2 = Project(Geometry=puntos_2, Plane=plano_3)  # -> Geometry, Transform
puntos_proyectados = Point(project_2.Geometry)
puntos_proyectados_2 = Point(puntos_proyectados)
puntos_3 = Point(puntos)
vec2pt = Vector2Pt(PointA=puntos_3, PointB=puntos_proyectados_2, Unitize=False)  # -> Vector, Length
vdis = VectorDisplay(Anchor=puntos_3, Vector=vec2pt.Vector)
