# Grasshopper definition 05-intersectar.gh (Grasshopper 1.0.8)

xy = Slider(181.114, range=0..360)
z = Slider(38.185, range=0..180)
x = Slider(3.081, range=-50..50)
y = Slider(21.203, range=-50..50)
z_2 = Slider(7.312, range=-50..50)
cono = Brep(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)
cone = Cone(Base=PlaneXY(0, 0, 0), Radius=0.5, Length=1)  # -> Cone, Tip
z_3 = Number(z)
xy_2 = Number(xy)
x_2 = Number(x)
y_2 = Number(y)
z_4 = Number(z_2)
z_5 = Number(z_3)
xy_3 = Number(xy_2)
x_3 = Number(x_2)
z_6 = Number(z_4)
y_3 = Number(y_2)
pt = ConstructPoint(XCoordinate=x_3, YCoordinate=y_3, ZCoordinate=z_6)
pt_2 = PointPolar(BasePlane=PlaneXY(0, 0, 0), XYAngle=degrees(xy_3), ZAngle=expr("90-x", degrees(z_5)), Offset=1)
origen = Point(pt)
normal = Vector(pt_2)
normal_2 = Vector(normal)
origen_2 = Point(origen)
pl = PlaneNormal(Origin=origen_2, ZAxis=normal_2)
xy_4 = XYPlane(Origin=Point(0, 0, 0))
plano = Plane(pl)
cono_2 = Brep(cono)
material = CreateMaterial(Diffuse=RGB(69, 191, 155), Specular=RGB(255, 255, 255), Emission=RGB(0, 0, 0), Transparency=0.5, Shine=0)
sec = BrepPlane(Brep=cono_2, Plane=plano)  # -> Curves, Points
preview = CustomPreview(Geometry=cono_2, Material=material)
