# Grasshopper definition ejercicio-planos-01.gh (Grasshopper 1.0.8)

# 1. Dado un plano, un radio y una altura, crear un cilíndro en el plano
plano = Plane(Plane(origin=(10.69321901, 8.418431567, 0), x=(-0.5988666712, 0.8008487436, 0), y=(0.5711180223, 0.4270763383, -0.7010206886)))
plano_2 = Plane(plano)
radio = Number(Slider(6.6, range=0..30))
altura = Number(Slider(27, range=0..50))
cono = Surface()
panel = Panel(cono)
