# Grasshopper definition ejercicio-planos-02.gh (Grasshopper 1.0.8)

# 2. Dado un círculo y un plano, reflejar el círculo con el plano
círculo = Circle({Plane=Plane(origin=(-7.699704302, -1.040916317, 0), x=(-0.9945824482, 0.1039507273, 0), y=(-0.1039507273, -0.9945824482, 0)), Radius=4.051087625})
plano = Plane(Plane(origin=(10.69321901, 8.418431567, 0), x=(-0.5988666712, 0.8008487436, 0), y=(0.5711180223, 0.4270763383, -0.7010206886)))
círculo_2 = Circle(círculo)
plano_2 = Plane(plano)
círculo_reflejado = Circle()
panel = Panel(círculo_reflejado)
