# Grasshopper definition ejercicio-planos-03.gh (Grasshopper 1.0.8)

# 3. Dado un plano, obtener su vector normal
# y la coordenada x de su origen
plano = Plane(Plane(origin=(10.69321901, 8.418431567, 0), x=(-0.5988666712, 0.8008487436, 0), y=(0.5711180223, 0.4270763383, -0.7010206886)))
plano_2 = Plane(plano)
vector_normal = Vector()
x_origen = Number()
panel = Panel(vector_normal)
panel_2 = Panel(x_origen)
