# Grasshopper definition ejercicio-planos-04.gh (Grasshopper 1.0.8)

# 4. Dado un plano, crear in círculo en él tal que su radio sea
# igual a la distancia entre el origen del plano y el origen universal
plano = Plane(Plane(origin=(10.69321901, 8.418431567, 0), x=(-0.5988666712, 0.8008487436, 0), y=(0.5711180223, 0.4270763383, -0.7010206886)))
plano_2 = Plane(plano)
origen_del_plano = Point()
origen_universal = Point(Point(0, 0, 0))
distancia_al_origen_del_plano = Number()
radio = Number(distancia_al_origen_del_plano)
círculo = Circle()
panel = Panel(círculo)
