# Grasshopper definition ejercicio-planos-05.gh (Grasshopper 1.0.8)

# 5. Dado un plano y un punto, obtener la distancia entre ambos
plano = Plane(Plane(origin=(10.69321901, 8.418431567, 0), x=(-0.5988666712, 0.8008487436, 0), y=(0.5711180223, 0.4270763383, -0.7010206886)))
punto = Point(Point(-11.10897331, 1.140853281, 0))
punto_2 = Point(punto)
plano_2 = Plane(plano)
distancia = Number()
panel = Panel(distancia)
