# Grasshopper definition ejercicio-planos-06.gh (Grasshopper 1.0.8)

# 6. Dado un plano y una distancia, crear un plano paralelo
plano = Plane(Plane(origin=(10.69321901, 8.418431567, 0), x=(-0.5988666712, 0.8008487436, 0), y=(0.5711180223, 0.4270763383, -0.7010206886)))
plano_2 = Plane(plano)
distancia = Number(Slider(6, range=-20..20))
plano_paralelo = Plane()
panel = Panel(plano_paralelo)
