# Grasshopper definition 01-vector.gh (Grasshopper 1.0.8)

x = Slider(19.082, range=-50..50)
y = Slider(21.718, range=-50..50)
z = Slider(16.406, range=-50..50)
margin = Number(Slider(1, range=0..5))
offset = Number(Slider(3, range=-5..5))
x_2 = Number(x)
y_2 = Number(y)
origen = Point(Point(0, 0, 0))
z_2 = Number(z)

margin_2 = Number(margin)
y_3 = Number(y_2)
subtraction = Subtraction(A="0", B=margin_2)
pt = ConstructPoint(XCoordinate=subtraction, YCoordinate=y_3, ZCoordinate=0)
pt_2 = ConstructPoint(XCoordinate=subtraction, YCoordinate=0, ZCoordinate=0)
offset_2 = Number(offset)
aligndim = AlignedDimension(Plane=PlaneXY(0, 0, 0), PointA=pt_2, PointB=pt, Offset=offset_2, Text="y = {0:0.00}", Size=1)

margin_3 = Number(margin)
z_3 = Number(z_2)
subtraction_2 = Subtraction(A="0", B=margin_3)
pt_3 = ConstructPoint(XCoordinate=subtraction_2, YCoordinate=0, ZCoordinate=0)
pt_4 = ConstructPoint(XCoordinate=subtraction_2, YCoordinate=0, ZCoordinate=z_3)
xz = XZPlane(Origin=Point(0, 0, 0))
offset_3 = Number(offset)
aligndim_2 = AlignedDimension(Plane=xz, PointA=pt_3, PointB=pt_4, Offset=offset_3, Text="x = {0:0.00}", Size=1)

margin_4 = Number(margin)
x_3 = Number(x_2)
subtraction_3 = Subtraction(A="0", B=margin_4)
pt_5 = ConstructPoint(XCoordinate=0, YCoordinate=subtraction_3, ZCoordinate=0)
pt_6 = ConstructPoint(XCoordinate=x_3, YCoordinate=subtraction_3, ZCoordinate=0)
offset_4 = Number(offset)
aligndim_3 = AlignedDimension(Plane=PlaneXY(0, 0, 0), PointA=pt_5, PointB=pt_6, Offset=expr("-x", offset_4), Text="x = {0:0.00}", Size=1)

x_4 = Number(x_2)
y_4 = Number(y_2)
z_4 = Number(z_2)
vec = VectorXYZ(XComponent=x_4, YComponent=y_4, ZComponent=z_4)  # -> Vector, Length
origen_2 = Point(Point(0, 0, 0))
vdisex = VectorDisplayEx(Point=origen_2, Vector=vec.Vector, Colour=RGB(0, 242, 255), Width=2)

panel = Panel("""0.5
0.5""")
linetype = ModelLinetype(Name="Line", Segments=panel, CapStyle=0, JoinStyle=0, Width=1, WidthUnits=0)  # -> ModelLinetype, Name, Segments, CapStyle, JoinStyle, Width, WidthUnits
linetype_2 = Linetype(linetype.ModelLinetype)

z_5 = Number(z_2)
vec_2 = VectorXYZ(XComponent=0, YComponent=0, ZComponent=z_5)  # -> Vector, Length
origen_3 = Point(Point(0, 0, 0))
vdis = VectorDisplay(Anchor=origen_3, Vector=vec_2.Vector)

x_5 = Number(x_2)
vec_3 = VectorXYZ(XComponent=x_5, YComponent=0, ZComponent=0)  # -> Vector, Length
origen_4 = Point(Point(0, 0, 0))
vdis_2 = VectorDisplay(Anchor=origen_4, Vector=vec_3.Vector)

y_5 = Number(y_2)
vec_4 = VectorXYZ(XComponent=0, YComponent=y_5, ZComponent=0)  # -> Vector, Length
origen_5 = Point(Point(0, 0, 0))
vdis_3 = VectorDisplay(Anchor=origen_5, Vector=vec_4.Vector)

vdisex_2 = VectorDisplayEx(Point=origen_3, Vector=vec_2.Vector, Colour=RGB(255, 0, 128), Width=2)
vdisex_3 = VectorDisplayEx(Point=origen_5, Vector=vec_4.Vector, Colour=RGB(166, 255, 0), Width=2)
vdisex_4 = VectorDisplayEx(Point=origen_4, Vector=vec_3.Vector, Colour=RGB(76, 0, 255), Width=2)
