# Grasshopper definition 01-remapear.gh (Grasshopper 1.0.8)

límite_inferior_1 = Slider(0, range=-50..50)
límite_superior_1 = Slider(50, range=-50..50)

valor_original = Slider(50, range=-50..50)
valor_original_2 = Slider(25, range=-50..50)
valor_original_3 = Slider(0, range=-50..50)

límite_inferior_2 = Slider(10, range=-50..50)
límite_superior_2 = Slider(25, range=-50..50)

límite_superior_1_2 = Number(límite_superior_1)
límite_superior_2_2 = Number(límite_superior_2)
separación_de_texto = Number(Slider(3, range=0..10))
límite_inferior_1_2 = Number(límite_inferior_1)
límite_inferior_2_2 = Number(límite_inferior_2)
valor_original_4 = Number([valor_original_2, valor_original_3, valor_original])
separación = Number(Slider(20, range=0..30))
separación_2 = Number(separación)
límite_superior_2_3 = Number(límite_superior_2_2)
límite_inferior_2_3 = Number(límite_inferior_2_2)
límite_superior_1_3 = Number(límite_superior_1_2)
límite_inferior_1_3 = Number(límite_inferior_1_2)
límite_superior_2_4 = Number(límite_superior_2_2)
límite_superior_1_4 = Number(límite_superior_1_2)
límite_inferior_1_4 = Number(límite_inferior_1_2)
límite_inferior_2_4 = Number(límite_inferior_2_2)
dom = ConstructDomain(DomainStart=límite_inferior_2_3, DomainEnd=límite_superior_2_3)
dom_2 = ConstructDomain(DomainStart=límite_inferior_1_3, DomainEnd=límite_superior_1_3)
pt = ConstructPoint(XCoordinate=límite_superior_2_4, YCoordinate=0, ZCoordinate=0)
pt_2 = ConstructPoint(XCoordinate=límite_superior_1_4, YCoordinate=separación_2, ZCoordinate=0)
pt_3 = ConstructPoint(XCoordinate=límite_inferior_2_4, YCoordinate=0, ZCoordinate=0)
pt_4 = ConstructPoint(XCoordinate=límite_inferior_1_4, YCoordinate=separación_2, ZCoordinate=0)
dominio_de_destino = Domain(dom)
dominio_de_origen = Domain(dom_2)
punto_límite_superior_2 = Point(pt)
punto_límite_superior_1 = Point(pt_2)
punto_límite_inferior_2 = Point(pt_3)
punto_límite_inferior_1 = Point(pt_4)
ln = Line(StartPoint=punto_límite_inferior_1, EndPoint=punto_límite_superior_1)
ln_2 = Line(StartPoint=punto_límite_inferior_2, EndPoint=punto_límite_superior_2)
dominio_de_destino_2 = Domain(dominio_de_destino)
valor_original_5 = Number(valor_original_4)
dominio_de_origen_2 = Domain(dominio_de_origen)
remap = RemapNumbers(Value=valor_original_5, Source=dominio_de_origen_2, Target=dominio_de_destino_2)  # -> Mapped, Clipped
valor_remapeado = Number(remap.Mapped)
valor_original_6 = Number(valor_original_4)
separación_3 = Number(separación)
valor_remapeado_2 = Number(valor_remapeado)
pt_5 = ConstructPoint(XCoordinate=valor_original_6, YCoordinate=separación_3, ZCoordinate=0)
pt_6 = ConstructPoint(XCoordinate=valor_remapeado_2, YCoordinate=0, ZCoordinate=0)
punto_valor_original = Point(pt_5)
punto_valor_remapeado = Point(pt_6)
vec2pt = Vector2Pt(PointA=punto_valor_original, PointB=punto_valor_remapeado, Unitize=False)  # -> Vector, Length
vdis = VectorDisplay(Anchor=punto_valor_original, Vector=vec2pt.Vector)
punto_valor_remapeado_2 = Point(punto_valor_remapeado)
punto_límite_superior_2_2 = Point(punto_límite_superior_2)
punto_límite_inferior_2_2 = Point(punto_límite_inferior_2)
valor_remapeado_3 = Number(valor_remapeado)
límite_inferior_2_5 = Number(límite_inferior_2_2)
límite_superior_2_5 = Number(límite_superior_2_2)
punto_límite_superior_1_2 = Point(punto_límite_superior_1)
punto_límite_inferior_1_2 = Point(punto_límite_inferior_1)
separación_de_texto_2 = Number(separación_de_texto)
punto_valor_original_2 = Point(punto_valor_original)
límite_superior_1_5 = Number(límite_superior_1_2)
límite_inferior_1_5 = Number(límite_inferior_1_2)
valor_original_7 = Number(valor_original_4)
separación_de_texto_3 = Number(separación_de_texto)
Y = UnitY(Factor=separación_de_texto_2)
merge = Merge(Data1=valor_remapeado_3, Data2=límite_inferior_2_5, Data3=límite_superior_2_5)
merge_2 = Merge(Data1=punto_valor_remapeado_2, Data2=punto_límite_inferior_2_2, Data3=punto_límite_superior_2_2)
merge_3 = Merge(Data1=valor_original_7, Data2=límite_inferior_1_5, Data3=límite_superior_1_5)
merge_4 = Merge(Data1=punto_valor_original_2, Data2=punto_límite_inferior_1_2, Data3=punto_límite_superior_1_2)
Y_2 = UnitY(Factor=separación_de_texto_3)
rev = Reverse(Vector=Y)
move = Move(Geometry=merge_2, Motion=rev)  # -> Geometry, Transform
move_2 = Move(Geometry=merge_4, Motion=Y_2)  # -> Geometry, Transform
tag = TextTag(Location=move.Geometry, Text=merge)
tag_2 = TextTag(Location=move_2.Geometry, Text=merge_3)
