# Grasshopper definition 02-dominio-2d.gh (Grasshopper 1.0.8)
# plug-ins: RhinoCodePluginGH

valor_u = Slider(8, range=-50..50)
valor_v = Slider(20, range=-50..50)

límite_inferior_u = Slider(-20, range=-50..50)
límite_superior_u = Slider(38, range=-50..50)

límite_inferior_v = Slider(-13, range=-50..50)
límite_superior_v = Slider(50, range=-50..50)

límite_superior_u_2 = Number(límite_superior_u)
límite_superior_v_2 = Number(límite_superior_v)
límite_inferior_u_2 = Number(límite_inferior_u)
límite_inferior_v_2 = Number(límite_inferior_v)
valor_v_2 = Number(valor_v)
valor_u_2 = Number(valor_u)
separación_cotas = Number(Slider(5, range=0..20))
límite_superior_v_3 = Number(límite_superior_v_2)
límite_superior_u_3 = Number(límite_superior_u_2)
límite_inferior_v_3 = Number(límite_inferior_v_2)
límite_inferior_u_3 = Number(límite_inferior_u_2)
valor_v_3 = Number(valor_v_2)
valor_u_3 = Number(valor_u_2)
límite_superior_u_4 = Number(límite_superior_u_2)
dom = ConstructDomain(DomainStart=límite_inferior_v_3, DomainEnd=límite_superior_v_3)
dom_2 = ConstructDomain(DomainStart=límite_inferior_u_3, DomainEnd=límite_superior_u_3)
límite_inferior_u_4 = Number(límite_inferior_u_2)
límite_inferior_v_4 = Number(límite_inferior_v_2)
límite_inferior_u_5 = Number(límite_inferior_u_2)
dominio_v = Domain(dom)
límite_superior_v_4 = Number(límite_superior_v_2)
límite_inferior_v_5 = Number(límite_inferior_v_2)
dominio_u = Domain(dom_2)
pt = ConstructPoint(XCoordinate=valor_u_3, YCoordinate=valor_v_3, ZCoordinate=0)
pt_2 = ConstructPoint(XCoordinate=límite_inferior_u_4, YCoordinate=expr("x-1", límite_inferior_v_4), ZCoordinate=0)
pt_3 = ConstructPoint(XCoordinate=límite_superior_u_4, YCoordinate=expr("x-1", límite_inferior_v_4), ZCoordinate=0)
punto_ub = Point(pt_3)
punto_ua = Point(pt_2)
valor_u_4 = Number(valor_u_2)
valor_v_4 = Number(valor_v_2)
pt_4 = ConstructPoint(XCoordinate=expr("x-1", límite_inferior_u_5), YCoordinate=límite_inferior_v_5, ZCoordinate=0)
Y = UnitY(Factor=Slider(3, range=0..10))
pt_5 = ConstructPoint(XCoordinate=expr("x-1", límite_inferior_u_5), YCoordinate=límite_superior_v_4, ZCoordinate=0)
c_script = CSharpScript()  # -> out, a
# ---------- c_script: C# ----------
// Grasshopper Script Instance
#region Usings
using System;
using System.Linq;
using System.Collections;
using System.Collections.Generic;
using System.Drawing;

using Rhino;
using Rhino.Geometry;

using Grasshopper;
using Grasshopper.Kernel;
using Grasshopper.Kernel.Data;
using Grasshopper.Kernel.Types;
#endregion

public class Script_Instance : GH_ScriptInstance
{
    #region Notes
    /* 
      Members:
        RhinoDoc RhinoDocument
        GH_Document GrasshopperDocument
        IGH_Component Component
        int Iteration

      Methods (Virtual & overridable):
        Print(string text)
        Print(string format, params object[] args)
        Reflect(object obj)
        Reflect(object obj, string method_name)
    */
    #endregion

    private void RunScript(object x, object y, ref object a)
    {
        // Write your logic here
        a = null;
    }
}
# ---------- end c_script ----------
format = Format(Format="U: {0}, V: {1}", Culture=127, Data0=valor_u_4, Data1=valor_v_4)
move = Move(Geometry=pt, Motion=Y)  # -> Geometry, Transform
punto_vb = Point(pt_5)
punto_va = Point(pt_4)
py3 = Python3Script()  # -> out, a; unedited script template
tag = TextTag(Location=move.Geometry, Text=format)
dominio_v_2 = Domain(dominio_v)
dominio_u_2 = Domain(dominio_u)
límite_superior_u_5 = Number(límite_superior_u_2)
límite_inferior_u_6 = Number(límite_inferior_u_2)
rectangle = Rectangle(Plane=PlaneXY(0, 0, 0), XSize=dominio_u_2, YSize=dominio_v_2, Radius=0)  # -> Rectangle, Length
límite_superior_v_5 = Number(límite_superior_v_2)
límite_inferior_v_6 = Number(límite_inferior_v_2)
separación_cotas_2 = Number(separación_cotas)
punto_ub_2 = Point(punto_ub)
punto_ua_2 = Point(punto_ua)
rectángulo = Rectangle(rectangle.Rectangle)
format_2 = Format(Format="U: [{0},{1}]", Culture=127, Data0=límite_inferior_u_6, Data1=límite_superior_u_5)
separación_cotas_3 = Number(separación_cotas)
punto_vb_2 = Point(punto_vb)
punto_va_2 = Point(punto_va)
format_3 = Format(Format="V: [{0},{1}]", Culture=127, Data0=límite_inferior_v_6, Data1=límite_superior_v_5)
aligndim = AlignedDimension(
    Plane=PlaneXY(0, 0, 0),
    PointA=punto_ua_2,
    PointB=punto_ub_2,
    Offset=expr("-x", separación_cotas_2),
    Text=format_2,
    Size=2)
aligndim_2 = AlignedDimension(Plane=PlaneXY(0, 0, 0), PointA=punto_va_2, PointB=punto_vb_2, Offset=separación_cotas_3, Text=format_3, Size=2)
