# Grasshopper definition 01-listas.gh (Grasshopper 1.0.8)

radios = Number([2.5, 3, 1.25, 4.1, 5, 3.6])
puntos = Point([Point(-14.67228055, 20.69599096, -3.620843884), Point(1.53864996, 25.52477877, 9.334642028), Point(5.677610941, 4.485060444, 5.259400908), Point(-6.394358589, -31.38593473, 2.740589295), Point(-35.36708546, -3.79286152, 7.287801542), Point(49.13670125, -14.8300908, 0)])
# índices
panel = Panel(radios)
# valores
panel_2 = Panel(puntos)
