# Grasshopper definition 02-extraer-elementos.gh (Grasshopper 1.0.8)

lista_de_puntos = Point([Point(-33, 11, 0), Point(-23, 20, 0), Point(-6, 22, 0), Point(16, 19, 0), Point(32, 2, 0), Point(31, -9, 0), Point(11, -14, 0), Point(-1, -13, 0), Point(-19, -8, 0), Point(-27, -1, 0)])
índices_a_obtener = Panel("""2
4
7""")
panel = Panel(lista_de_puntos)
item = ListItem(List=lista_de_puntos, Index=índices_a_obtener, Wrap=True)
puntos = Point(item)
points = PointList(Points=lista_de_puntos, Size=3)
panel_2 = Panel(puntos)
