# Grasshopper definition 03-longitud.gh (Grasshopper 1.0.8)

lista_de_círculos = Circle([{Plane=Plane(origin=(-30, 30, 0), x=(-0.8320502943, -0.5547001962, 0), y=(0.5547001962, -0.8320502943, 0)), Radius=3.605551275}, {Plane=Plane(origin=(-14, 20, 0), x=(-0.6246950476, -0.7808688094, 0), y=(0.7808688094, -0.6246950476, 0)), Radius=6.403124237}, {Plane=Plane(origin=(-15, 2, 0), x=(-1, 0, 0), y=(0, -1, 0)), Radius=4}, {Plane=Plane(origin=(9, 21, 0), x=(-0.7071067812, -0.7071067812, 0), y=(0.7071067812, -0.7071067812, 0)), Radius=4.242640687}, {Plane=Plane(origin=(9, 7, 0), x=(-0.5144957554, -0.8574929257, 0), y=(0.8574929257, -0.5144957554, 0)), Radius=5.830951895}, {Plane=Plane(origin=(4, -8, 0), x=(-0.9863939238, -0.1643989873, 0), y=(0.1643989873, -0.9863939238, 0)), Radius=6.08276253}, {Plane=Plane(origin=(-22, -14, 0), x=(-0.9486832981, 0.316227766, 0), y=(-0.316227766, -0.9486832981, 0)), Radius=6.32455532}])
lng = ListLength(List=lista_de_círculos)
longitud_de_la_lista = Number(lng)
longitud_de_la_lista_2 = Panel(longitud_de_la_lista)
