# Grasshopper definition 01-numeros-consecutivos.gh (Grasshopper 1.0.8)

cantidad_de_números = Panel("5")
# creación de la lista
# de números
valor_inicial = Panel("2")
incremento = Panel("3")
series = Series(Start=valor_inicial, Step=incremento, Count=cantidad_de_números)
lista_de_números = Number(series)
# lista de números
panel = Panel(series)
coordenadas_x = Number(lista_de_números)
radios = Number(lista_de_números)
cir = Circle(Plane=PlaneXY(0, 0, 0), Radius=radios)
# se usan para crear puntos
pt = ConstructPoint(XCoordinate=coordenadas_x, YCoordinate=0, ZCoordinate=0)
círculos = Circle(cir)
# se usan para
# crear círculos
puntos = Point(pt)
