# Grasshopper definition 02-dividir-dominio.gh (Grasshopper 1.0.8)

límite_superior = Panel("10")
# se crea
# el dominio
límite_inferior = Panel("-10")
número_de_divisiones = Panel("5")
# se divide
# el dominio
dom = ConstructDomain(DomainStart=límite_inferior, DomainEnd=límite_superior)
range = Range(Domain=dom, Steps=número_de_divisiones)
lista_de_números = Number(range)
# se usan como distancias
# para crear planos paralelos
panel = Panel(lista_de_números)
distancias_para_mover = Number(lista_de_números)
sph = Sphere(Base=PlaneXY(0, 0, 0), Radius=1)
# se usan para crear
# vectores de movimiento
Y = UnitY(Factor=distancias_para_mover)
distancias = Number(lista_de_números)
xy = XYPlane(Origin=Point(0, 0, 0))
pl_offset = PlaneOffset(BasePlane=xy, Offset=distancias)
move = Move(Geometry=sph, Motion=Y)  # -> Geometry, Transform
planos_paralelos = Plane(pl_offset)
objetos_movidos = Surface(move.Geometry)
