# Grasshopper definition 03-repetir-secuencia.gh (Grasshopper 1.0.8)

longitud_de_la_lista = Panel("7")
# se crea la lista de la
# secuencia repetida
secuencia_a_repetir = Panel("""10
20
30""")
repeat = RepeatData(Data=secuencia_a_repetir, Length=longitud_de_la_lista)
lista_de_números = Number(repeat)
panel = Panel(repeat)
distancias_a_extruir = Number(lista_de_números)
# se usan para crear
# vectores para extruir
rectángulos = Rectangle([{Plane=PlaneXY(-26.29980305, 7.663699396, 0), Size=Domain2(u=-2.488447539..2.488447539, v=-1.957669417..1.957669417)}, {Plane=PlaneXY(-18.1739027, 6.981965798, 0), Size=Domain2(u=-2.715815122..2.715815122, v=-2.324020604..2.324020604)}, {Plane=PlaneXY(-9.991743132, 6.678600226, 0), Size=Domain2(u=-2.058793926..2.058793926, v=-4.534070725..4.534070725)}, {Plane=PlaneXY(-2.984604723, 6.895973401, 0), Size=Domain2(u=-1.885375462..1.885375462, v=-2.786360613..2.786360613)}, {Plane=PlaneXY(4.617800728, 6.41694773, 0), Size=Domain2(u=-3.137944279..3.137944279, v=-3.754501092..3.754501092)}, {Plane=PlaneXY(13.58178341, 6.435445852, 0), Size=Domain2(u=-3.043806748..3.043806748, v=-3.495068927..3.495068927)}, {Plane=PlaneXY(22.83056847, 6.500030647, 0), Size=Domain2(u=-2.906914096..2.906914096, v=-4.087697991..4.087697991)}])
Z = UnitZ(Factor=distancias_a_extruir)
extr = Extrude(Base=rectángulos, Direction=Z)
extrusiones = Brep(extr)
