# Grasshopper definition 04-repetir-secuencia-n.gh (Grasshopper 1.0.8)

número_de_repeticiones = Panel("3")
# se crea la lista de la
# secuencia repetida
secuencia_a_repetir = Panel("""10
25
5""")
dup = DuplicateData(Data=secuencia_a_repetir, Number=número_de_repeticiones, Order=True)
lista_de_números = Number(dup)
panel = Panel(dup)
distancias_a_extruir = Number(lista_de_números)
# se usan para crear
# vectores para extruir
rectángulos = Rectangle([{Plane=PlaneXY(-26.29980305, 7.663699396, 0), Size=Domain2(u=-2.488447539..2.488447539, v=-1.957669417..1.957669417)}, {Plane=PlaneXY(-18.1739027, 6.981965798, 0), Size=Domain2(u=-2.715815122..2.715815122, v=-2.324020604..2.324020604)}, {Plane=PlaneXY(-9.991743132, 6.678600226, 0), Size=Domain2(u=-2.058793926..2.058793926, v=-4.534070725..4.534070725)}, {Plane=PlaneXY(-2.984604723, 6.895973401, 0), Size=Domain2(u=-1.885375462..1.885375462, v=-2.786360613..2.786360613)}, {Plane=PlaneXY(4.617800728, 6.41694773, 0), Size=Domain2(u=-3.137944279..3.137944279, v=-3.754501092..3.754501092)}, {Plane=PlaneXY(13.58178341, 6.435445852, 0), Size=Domain2(u=-3.043806748..3.043806748, v=-3.495068927..3.495068927)}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])
Z = UnitZ(Factor=distancias_a_extruir)
extr = Extrude(Base=rectángulos, Direction=Z)
extrusiones = Brep(extr)
