# Grasshopper definition 01-patron.gh (Grasshopper 1.0.8)

puntos = Point([Point(0, 10, 0), Point(5, 10, 0), Point(10, 10, 0), Point(15, 10, 0), Point(20, 10, 0), Point(25, 10, 0), Point(30, 10, 0), Point(35, 10, 0), Point(40, 10, 0), Point(45, 10, 0), Point(50, 10, 0), Point(55, 10, 0), Point(60, 10, 0)])
lng = ListLength(List=puntos)
# se crear el patrón
# para filtrar
longitud_de_la_lista = Panel(lng)
longitud_de_la_lista_2 = Number(lng)
patrón_a_repetir = Panel("""1
0
0""")
# se aplica el filtro
repeat = RepeatData(Data=patrón_a_repetir, Length=longitud_de_la_lista_2)
patrón = Panel(repeat)
cull = CullPattern(List=puntos, CullPattern=repeat)
lista_para_filtrar = Panel(puntos)
puntos_filtrados = Point(cull)
lista_filtrada = Panel(cull)
