# Grasshopper definition 02-patron-condiciones.gh (Grasshopper 1.0.8)

puntos = Point([Point(-10.05325663, -15.57024091, -1.319572805), Point(14.25859254, 10.94815988, -16.446124), Point(-16.15982011, 18.06759346, -0.6964820534), Point(14.44682982, 17.80734593, 18.88198797), Point(14.73262254, -19.49256977, 18.55961732), Point(-15.9174123, 0.4033083564, -19.39901907)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])
# se crea el patrón
# con una condición
# para filtrar
origen = Point(Point(0, 0, 0))
distancia_máxima = Slider(18, range=0..20)
dist = Distance(PointA=puntos, PointB=origen)
distancia_al_origen = Number(dist)
smaller = SmallerThan(FirstNumber=distancia_al_origen, SecondNumber=distancia_máxima)  # -> SmallerThan, OrEqualTo
# se aplica el filtro
la_distancia_es_menor_que_la_máxima = Boolean(smaller.SmallerThan)
patrón = Panel(la_distancia_es_menor_que_la_máxima)
lista_para_filtrar = Panel(puntos)
cull = CullPattern(List=puntos, CullPattern=la_distancia_es_menor_que_la_máxima)
lista_filtrada = Panel(cull)
puntos_filtrados = Point(cull)
