# Grasshopper definition 03-indices.gh (Grasshopper 1.0.8)

líneas = Line([Line((-41, 6, 0), (-39, 22, 0)), Line((-30, 5, 0), (-30, 21, 0)), Line((-19, 4, 0), (-20, 22, 0)), Line((-8, 6, 0), (-6, 19, 0)), Line((2, 5, 0), (1, 20, 0)), Line((14, 6, 0), (15, 20, 0)), Line((29, 6, 0), (27, 22, 0)), Line((40, 6, 0), (37, 24, 0)), Line((45, 8, 0), (47, 22, 0)), Line((55, 6, 0), (56, 22, 0))])
índices_a_eliminar = Panel("""1
3
4
8
-1""")
cull_i = CullIndex(List=líneas, Indices=índices_a_eliminar, Wrap=True)
lista_a_filtrar = Panel(líneas)
líneas_filtradas = Line(cull_i)
lista_filtrada = Panel(líneas_filtradas)
