# Grasshopper definition 04-aleatoria.gh (Grasshopper 1.0.8)

número_de_elementos_a_eleiminar = Slider(600, range=0..700)
puntos = Point([Point(-10.05325663, -15.57024091, -1.319572805), Point(14.25859254, 10.94815988, -16.446124), Point(-16.15982011, 18.06759346, -0.6964820534), Point(14.44682982, 17.80734593, 18.88198797), Point(14.73262254, -19.49256977, 18.55961732), Point(-15.9174123, 0.4033083564, -19.39901907)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])
reduce = RandomReduce(List=puntos, Reduction=número_de_elementos_a_eleiminar, Seed=1)
puntos_filtrados = Point(reduce)
