# Grasshopper definition 01-ordenamiento.gh (Grasshopper 1.0.8)

# se usa la distancia al origen de cada punto
# como clave de ordenamiento
puntos = Point([Point(-10.05325663, -15.57024091, -1.319572805), Point(14.25859254, 10.94815988, -16.446124), Point(-16.15982011, 18.06759346, -0.6964820534), Point(14.44682982, 17.80734593, 18.88198797), Point(14.73262254, -19.49256977, 18.55961732), Point(-15.9174123, 0.4033083564, -19.39901907)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])
# se usa la coordenada z de cada punto
# como clave de ordenamiento
pdecon = Deconstruct(Point=puntos)  # -> XComponent, YComponent, ZComponent
origen = Point(Point(0, 0, 0))
coordenadas_z = Number(pdecon.ZComponent)
dist = Distance(PointA=puntos, PointB=origen)
distancia_al_origen = Number(dist)
sort = SortList(Keys=coordenadas_z, ValuesA=puntos)  # -> Keys, ValuesA
sort_2 = SortList(Keys=distancia_al_origen, ValuesA=puntos)  # -> Keys, ValuesA
coordenadas_z_ordenadas = Number(sort.Keys)
puntos_ordenados_por_su_coordenada_z = Point(sort.ValuesA)
distancias_al_origen_ordenadas = Number(sort_2.Keys)
puntos_ordenados_por_su_distancia_al_ori = Point(sort_2.ValuesA)  # "puntos ordenados por su distancia al origen"
panel = Panel(coordenadas_z_ordenadas)
panel_2 = Panel(distancias_al_origen_ordenadas)
