# Grasshopper definition 02-insertar.gh (Grasshopper 1.0.8)

puntos_a_insertar = Point([Point(-1, 22, 0), Point(27, 23, 0)])
índice_de_inserción = Panel("""2
4""")
lista_de_puntos = Point([Point(-27, 2, 0), Point(-16, 3, 0), Point(-6, -1, 0), Point(9, 4, 0), Point(22, -1, 0), Point(37, 3, 0)])
ins = InsertItems(List=lista_de_puntos, Item=puntos_a_insertar, Indices=índice_de_inserción, Wrap=True)
order = PointOrder(Points=ins)
points = PointList(Points=lista_de_puntos, Size=3)
