# Grasshopper definition 03-particiones.gh (Grasshopper 1.0.8)

tamaño_de_las_particiones = Panel("4")
lista_de_puntos = Point([Point(-30.52355442, 13.71446383, 0), Point(-27.94198475, 16, 0), Point(-24.11402628, 14.19368089, 0), Point(-19.5015621, 15.03231074, 0), Point(-14.76929365, 16.52986405, 0), Point(-11.29496998, 14.07387663, 0), Point(-6.862212201, 16.05064699, 0), Point(-3.56759493, 14.19368089, 0), Point(-0.0932712619, 17.06898324, 0), Point(3.680563067, 14.73280008, 0), Point(8.293027247, 15.87094059, 0), Point(12.18666584, 13.71446383, 0), Point(15.18177245, 16.70957044, 0), Point(19.25511744, 14.37338729, 0), Point(22.48983258, 17.48829816, 0), Point(26.38347117, 15.57142993, 0), Point(31, 16, 0)])
panel = Panel(lista_de_puntos)
partition = PartitionList(List=lista_de_puntos, Size=tamaño_de_las_particiones)
particiones = Point(partition)
points = PointList(Points=particiones, Size=3)
panel_2 = Panel(particiones)
