# Grasshopper definition 04-recorrer.gh (Grasshopper 1.0.8)

número_de_posiciones_a_recorrer = Panel("3")
lista_de_puntos = Point([Point(-31, 20, 0), Point(-19, 21, 0), Point(-7, 19, 0), Point(5, 21, 0), Point(16, 21, 0), Point(30, 16, 0), Point(38, 20, 0)])
shift = ShiftList(List=lista_de_puntos, Shift=número_de_posiciones_a_recorrer, Wrap=True)
panel = Panel(lista_de_puntos)
lista_de_puntos_recorrida = Point(shift)
panel_2 = Panel(lista_de_puntos_recorrida)
points = PointList(Points=lista_de_puntos_recorrida, Size=3)
