# Grasshopper definition 05-dividir.gh (Grasshopper 1.0.8)

índice_del_inicio_de_la_segunda_sublista = Panel("4")
lista_de_puntos = Point([Point(-48, 13, 0), Point(-31, 9, 0), Point(-15, 11, 0), Point(-1, 5, 0), Point(12, 10, 0), Point(24, 6, 0), Point(40, 9, 0), Point(54, 4, 0), Point(72, 5, 0)])
lista_original = Panel(lista_de_puntos)
split = SplitList(List=lista_de_puntos, Index=índice_del_inicio_de_la_segunda_sublista)  # -> ListA, ListB
primera_sublista = Point(split.ListA)
segunda_sublista = Point(split.ListB)
primera_sublista_2 = Panel(primera_sublista)
segunda_sublista_2 = Panel(segunda_sublista)
points = PointList(Points=primera_sublista, Size=3)
points_2 = PointList(Points=segunda_sublista, Size=3)
