# Grasshopper definition 06-sublista.gh (Grasshopper 1.0.8)

índice_inicial = Panel("2")
lista_de_puntos = Point([Point(-23, 10, 0), Point(-18, 10, 0), Point(-14, 11, 0), Point(-8, 11, 0), Point(-4, 10, 0), Point(2, 10, 0), Point(12, 10, 0), Point(17, 10, 0)])
índice_final = Panel("6")
dom = ConstructDomain(DomainStart=índice_inicial, DomainEnd=índice_final)
dominio_de_índices = Domain(dom)
subset = SubList(List=lista_de_puntos, Domain=dominio_de_índices, Wrap=True)  # -> List, Index
lista_original = Panel(lista_de_puntos)
sublista_de_puntos = Point(subset.List)
lista_original_2 = Panel(sublista_de_puntos)
points = PointList(Points=sublista_de_puntos, Size=2)
