# Grasshopper definition 01-separar.gh (Grasshopper 1.0.8)

lista_de_puntos = Point([Point(0, 10, 0), Point(5, 10, 0), Point(10, 10, 0), Point(15, 10, 0), Point(20, 10, 0), Point(25, 10, 0), Point(30, 10, 0), Point(35, 10, 0), Point(40, 10, 0), Point(45, 10, 0), Point(50, 10, 0), Point(55, 10, 0), Point(60, 10, 0)])
patrón = Panel("""1
0
0""")
dispatch = Dispatch(List=lista_de_puntos, DispatchPattern=patrón)  # -> ListA, ListB
patrón_2 = Panel("""1
0
0
1
0
0
1
0
0
1
0
0
1""")
lista_a_separar = Panel(lista_de_puntos)
lista_a = Point(dispatch.ListA)
lista_b = Point(dispatch.ListB)
lista_a_2 = Panel(lista_a)
points = PointList(Points=lista_a, Size=2)
lista_b_2 = Panel(lista_b)
points_2 = PointList(Points=lista_b, Size=2)
