# Grasshopper definition 02-seleccionar.gh (Grasshopper 1.0.8)

patrón = Panel("""0
1
1
0
1
0
0
0
1""")
otros_puntos = Point([Point(-8, 54, 0), Point(-8, 45, 0), Point(-8, 38, 0), Point(-6, 29, 0), Point(-8, 26, 0), Point(-7, 20, 0), Point(-8, 12, 0), Point(-8, 3, 0), Point(-6, 0, 0), Point(-7, -6, 0), Point(-11, -13, 0), Point(-9, -21, 0), Point(-10, -27, 0)])
puntos = Point([Point(-31, 48, 0), Point(-31, 40, 0), Point(-30, 31, 0), Point(-31, 25, 0), Point(-30, 15, 0), Point(-30, 6, 0), Point(-32, 0, 0), Point(-31, -8, 0)])
patrón_2 = Panel(patrón)
lista_0 = Panel(puntos)
p_n_c = PickNChoose(Pattern=patrón, Stream0=puntos, Stream1=otros_puntos)
lista_1 = Panel(otros_puntos)
points = PointList(Points=puntos, Size=3)
order = PointOrder(Points=p_n_c)
points_2 = PointList(Points=otros_puntos, Size=3)
dispatch = Dispatch(DispatchPattern=[True, False])  # -> ListA, ListB
