# Grasshopper definition 03-entrelazar.gh (Grasshopper 1.0.8)

otra_lista_de_puntos = Point([Point(-13, 38, 0), Point(-14, 32, 0), Point(-12, 27, 0), Point(-13, 22, 0), Point(-13, 17, 0), Point(-13, 12, 0), Point(-12, 6, 0), Point(-12, 1, 0), Point(-13, -2, 0)])
lista_de_puntos = Point([Point(-35, 38, 0), Point(-36, 32, 0), Point(-34, 25, 0), Point(-34, 20, 0), Point(-35, 15, 0), Point(-35, 9, 0), Point(-33, 2, 0), Point(-36, -3, 0)])
patrón = Panel("""0
1
1""")
lista_0 = Panel(lista_de_puntos)
weave = Weave(Pattern=patrón, Stream0=lista_de_puntos, Stream1=otra_lista_de_puntos, NullGaps=False)
lista_1 = Panel(otra_lista_de_puntos)
listas_entrelazadas = Point(weave)
points = PointList(Points=lista_de_puntos, Size=3)
points_2 = PointList(Points=otra_lista_de_puntos, Size=3)
# orden de los elementos: lista 0[0]
# lista 1[0]
# lista 1[1]
# lista 0[1]
# lista 1[2]
# lista 1[3]
# lista 0[2]
# lista 1[4]
# lista 1[5]
# lista 0[3]
# lista 1[6]
# lista 1[7]
# lista 0[4]
# lista 1[8]
# lista 0[5]
# lista 0[6]
# lista 0[7]
listas_entrelazadas_2 = Panel(listas_entrelazadas)
order = PointOrder(Points=listas_entrelazadas)
