# Grasshopper definition 01-linea-dos-puntos.gh (Grasshopper 1.0.8)

puntos_iniciales = Point([Point(-25, -7, 0), Point(-22.76694729, -2.57868279, 0), Point(-20.19089443, 1.651139229, 0), Point(-17.1849927, 5.585439268, 0), Point(-13.65890311, 9.057909898, 0), Point(-9.567925056, 11.83763828, 0), Point(-4.99147407, 13.71084495, 0), Point(-0.1331877775, 14.64663661, 0), Point(4.814023159, 14.84881641, 0), Point(9.763003503, 14.63333585, 0), Point(14.70782901, 14.32942551, 0), Point(19.66020064, 14.27477001, 0), Point(24.58635163, 14.76760144, 0), Point(29.37617885, 16.00622853, 0), Point(33.75374506, 18.29059959, 0), Point(37.06092089, 21.93007248, 0), Point(38.49100276, 26.63296525, 0), Point(38.14462161, 31.55734534, 0), Point(36.67737154, 36.28245859, 0), Point(34.54767923, 40.75256325, 0), Point(32, 45, 0)])
puntos_finales = Point([Point(-20.97926697, -3, 16.87398713), Point(-18.79302784, -1.018648477, 17.23114268), Point(-16.60678872, 0.962703046, 17.58829822), Point(-14.42054959, 2.944054569, 17.94545377), Point(-12.23431046, 4.925406092, 18.30260931), Point(-10.04807134, 6.906757615, 18.65976486)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])
ln = Line(StartPoint=puntos_iniciales, EndPoint=puntos_finales)
líneas = Line(ln)
