# Grasshopper definition 02-linea-sdl.gh (Grasshopper 1.0.8)

longitud = Slider(10, range=0..50)
vectores_de_dirección = Vector([Vector(0, 0, 10.5), Vector(0, 0, 10.5), Vector(0, 0, 10.5), Vector(0, 0, 10.5), Vector(0, 0, 10.5), Vector(0, 0, 10.5)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])
puntos_iniciales = Point([Point(0, 0, 10.5), Point(0, 0, 10.5), Point(0, 0, 10.5), Point(0, 0, 10.5), Point(0, 0, 10.5), Point(0, 0, 10.5)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])
line = LineSDL(Start=puntos_iniciales, Direction=vectores_de_dirección, Length=longitud)
líneas = Line(line)
