# Grasshopper definition 03-lineas-tangentes-desde-punto.gh (Grasshopper 1.0.8)

punto = Point(Point(35, 23, 0))
círculo = Circle({Plane=Plane(origin=(3, 10, 0), x=(-0.7071067812, -0.7071067812, 0), y=(0.7071067812, -0.7071067812, 0)), Radius=11.3137085})
tan = TangentLines(Point=punto, Circle=círculo)  # -> Tangent1, Tangent2
línea_tangente_1 = Line(tan.Tangent1)
línea_tangente_2 = Line(tan.Tangent2)
