# Grasshopper definition 04-lineas-tangentes-externas.gh (Grasshopper 1.0.8)

círculo_a = Circle({Plane=Plane(origin=(10, 20, 0), x=(-0.8778955729, -0.4788521307, 0), y=(0.4788521307, -0.8778955729, 0)), Radius=12.52996409})
círculo_b = Circle({Plane=Plane(origin=(41, 21, 0), x=(-0.7071067812, -0.7071067812, 0), y=(0.7071067812, -0.7071067812, 0)), Radius=7.071067812})
tanex = TangentLinesEx(CircleA=círculo_a, CircleB=círculo_b)  # -> Tangent1, Tangent2
línea_tangente_1 = Line(tanex.Tangent1)
línea_tangente_2 = Line(tanex.Tangent2)
