# Grasshopper definition 05-lineas-tangentes-internas.gh (Grasshopper 1.0.8)

círculo_a = Circle({Plane=Plane(origin=(-18, 36, 0), x=(-0.8137334712, -0.5812381937, 0), y=(0.5812381937, -0.8137334712, 0)), Radius=8.602325267})
círculo_b = Circle({Plane=Plane(origin=(19, 31, 0), x=(-0.7682212796, -0.6401843997, 0), y=(0.6401843997, -0.7682212796, 0)), Radius=15.62049935})
tanin = TangentLinesIn(CircleA=círculo_a, CircleB=círculo_b)  # -> Tangent1, Tangent2
línea_tangente_1 = Line(tanin.Tangent1)
línea_tangente_2 = Line(tanin.Tangent2)
