# Grasshopper definition 06-circulo-base-radio.gh (Grasshopper 1.0.8)

radio = Slider(10, range=0..30)
planos_base = Plane([Plane(origin=(4, -38, 10), x=(0.5436797875, 0.7481620055, 0.3803497104), y=(0.4970977925, 0.07809271541, -0.8641731959)), Plane(origin=(-0.4652183806, -33.51262702, 7.836471282), x=(0.5659184205, 0.7257820914, 0.3911223556), y=(0.4972373182, 0.07795082409, -0.8641057333)), Plane(origin=(-4.783203053, -28.83935268, 5.770567645), x=(0.5943696098, 0.6949234659, 0.4047297165), y=(0.4977884546, 0.07735002183, -0.8638423633)), Plane(origin=(-8.8882263, -23.92408015, 3.838099847), x=(0.6321510755, 0.6495184096, 0.4225054477), y=(0.4990833285, 0.07578665458, -0.8632335803)), Plane(origin=(-12.65955583, -18.68100142, 2.101830052), x=(0.6844646508, 0.5762705432, 0.4465651161), y=(0.5017869072, 0.07197972876, -0.8619911939)), Plane(origin=(-15.84442301, -12.97834834, 0.6860937352), x=(0.7584283196, 0.4415804314, 0.4793675069), y=(0.5071695967, 0.06208590401, -0.8596070851))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])
radios = Number([5.977420669, 5.743692908, 5.865149159, 6.327988691, 7.079620362, 8.034638395, 9.084526799, 10.10998973, 10.99450675, 11.63757268, 11.96611779, 11.9428104, 11.57029888, 10.89091066, 9.981842691, 8.946389788, 7.90220753, 6.967943387, 6.249755145, 5.829248496, 5.75420442])
cir = Circle(Plane=planos_base, Radius=radios)
círculos = Circle(cir)
