# Grasshopper definition 07-circulo-cnr.gh (Grasshopper 1.0.8)

radio = Slider(3, range=0..10)
centros = Point([Point(0, 0, 0), Point(0, 8.660254038, 0), Point(0, 17.32050808, 0), Point(0, 25.98076211, 0), Point(0, 34.64101615, 0), Point(0, 43.30127019, 0)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])

atractor = Point(Point(33.0863636, 50.73108639, 22.84917168))
vec2pt = Vector2Pt(PointA=centros, PointB=atractor, Unitize=False)  # -> Vector, Length

vectores_normales = Vector(vec2pt.Vector)
circle = CircleCNR(Center=centros, Normal=vectores_normales, Radius=radio)
