# Grasshopper definition 08-circulo-tres-puntos.gh (Grasshopper 1.0.8)

puntos_a = Point([Point(-0.02265361818, -16.57066051, -0.5627054896), Point(0.2255170628, -14.99644478, 2.514717918), Point(0.4806282781, -13.60819316, 5.679607609), Point(0.7428821592, -12.45527531, 8.936691917), Point(1.011805992, -11.60181799, 12.28369039), Point(1.285587227, -11.12581254, 15.70373084)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])
puntos_c = Point([Point(28.11363584, 8.983841595, 0), Point(26.41282067, 7.985399851, 3.041440435), Point(24.86582581, 7.035254759, 6.178966429), Point(23.47561607, 6.135567702, 9.403556655), Point(22.24341384, 5.287899024, 12.70557809), Point(21.16873728, 4.493184267, 16.07512587)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])
puntos_b = Point([Point(-7, 10, 0), Point(-5.535302721, 8.810319153, 3.371115397), Point(-4.259312002, 7.718765952, 6.850296401), Point(-3.192056084, 6.737581148, 10.43105271), Point(-2.352628696, 5.878893452, 14.10268133), Point(-1.75767164, 5.153866768, 17.85002422)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])
circle = Circle3Pt(PointA=puntos_a, PointB=puntos_b, PointC=puntos_c)  # -> Circle, Plane, Radius
círculos = Circle(circle.Circle)
planos_base = Plane(circle.Plane)
radios = Number(circle.Radius)
radios_2 = Panel(radios)
