# Grasshopper definition 09-arco-plano-radio-angulo.gh (Grasshopper 1.0.8)

ángulo_inicial = Slider(20, range=0..360)
ángulo_final = Slider(90, range=0..360)
radio = Slider(15, range=0..20)
plano_base = Plane(Plane(origin=(-1, 1, 0), x=(-0.5144957554, 0.8574929257, 0), y=(-0.6300887556, -0.3780532533, 0.6782801027)))
rad = Radians(Degrees=ángulo_inicial)
rad_2 = Radians(Degrees=ángulo_final)
dom = ConstructDomain(DomainStart=rad, DomainEnd=rad_2)
arc = Arc(Plane=plano_base, Radius=radio, Angle=dom)  # -> Arc, Length
arco = CircularArc(arc.Arc)
longitud = Number(arc.Length)
