# Grasshopper definition 10-arco-tres-puntos.gh (Grasshopper 1.0.8)

puntos_a = Point([Point(35, -1, 0), Point(34.44307771, 6.298761586, 0), Point(32.38082805, 13.32223609, 0), Point(28.90338002, 19.76346689, 0), Point(24.16271595, 25.34093838, 0), Point(18.36602526, 29.81088922, 0)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])
puntoc_c = Point([Point(10, 6, 0), Point(9.781476007, 8.079116911, 0), Point(9.135454697, 10.06736616, 0), Point(8.090169933, 11.87785254, 0), Point(6.691306034, 13.43144828, 0), Point(4.999999957, 14.66025406, 0)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])
puntos_b = Point([Point(26, -4.053171996, 11.8081273), Point(25.43183762, 1.168337075, 13.20722643), Point(23.75218221, 6.161640454, 14.54517804), Point(21.03444183, 10.70850888, 15.76350777), Point(17.39739569, 14.61022034, 16.8089682), Point(12.99999989, 17.69625196, 17.63586788)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])
arc = Arc3Pt(PointA=puntos_a, PointB=puntos_b, PointC=puntoc_c)  # -> Arc, Plane, Radius
arcos = CircularArc(arc.Arc)
planos_base = Plane(arc.Plane)
radios = Number(arc.Radius)
radios_2 = Panel(radios)
