# Grasshopper definition 11-arco-sed.gh (Grasshopper 1.0.8)

puntos_iniciales = Point([Point(15, -32, 0), Point(15, -27.55, 0), Point(15, -23.1, 0), Point(15, -18.65, 0), Point(15, -14.2, 0), Point(15, -9.75, 0), Point(15, -5.3, 0), Point(15, -0.85, 0), Point(15, 3.6, 0), Point(15, 8.05, 0), Point(15, 12.5, 0), Point(15, 16.95, 0), Point(15, 21.4, 0), Point(15, 25.85, 0), Point(15, 30.3, 0), Point(15, 34.75, 0), Point(15, 39.2, 0), Point(15, 43.65, 0), Point(15, 48.1, 0), Point(15, 52.55, 0), Point(15, 57, 0)])
puntos_finales = Point([Point(-4, -34, -7), Point(-2.347077302, -29.27525394, -6.265640183), Point(-0.8753004938, -24.55216779, -5.203406514), Point(0.4277704936, -19.83455705, -3.918207181), Point(1.57065787, -15.11795313, -2.484748725), Point(2.557507983, -10.39480792, -0.9595642998)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])
dirección = Vector(Vector(0, 0, 1))
arc = ArcSED(Start=puntos_iniciales, End=puntos_finales, Direction=dirección)  # -> Arc, Plane, Radius
arcos = CircularArc(arc.Arc)
planos_base = Plane(arc.Plane)
radios = Number(arc.Radius)
radios_2 = Panel(radios)
