# Grasshopper definition 12-rectangulo-plano-dominios.gh (Grasshopper 1.0.8)

x_inicial = Slider(-10.524, range=-20..20)
y_inicial = Slider(-2.55, range=-20..20)
x_final = Slider(11.111, range=-20..20)
y_final = Slider(3.168, range=-20..20)
dom = ConstructDomain(DomainStart=x_inicial, DomainEnd=x_final)
dom_2 = ConstructDomain(DomainStart=y_inicial, DomainEnd=y_final)
planos_base = Plane([Plane(origin=(30, 0, 0), x=(0.9999989983, 0.001360518877, 0.0003903728845), y=(0, 0.2758008033, -0.9612148131)), Plane(origin=(26.96143178, 13.15562367, 3.94983806), x=(0.8987280222, 0.4385064903, -5.461685888e-06), y=(-0.1221742671, 0.2503866977, -0.9604061381)), Plane(origin=(18.46200213, 23.64644746, 7.900025191), x=(0.6154013167, 0.7882139427, -4.584141877e-07), y=(-0.2195742911, 0.1714329832, -0.9604154637)), Plane(origin=(6.222785461, 29.34743271, 11.85002242), x=(0.2074267615, 0.97825055, 3.621676486e-09), y=(-0.2725064315, 0.05778185359, -0.9604173583)), Plane(origin=(-7.276859749, 29.10407724, 15.80001887), x=(-0.2425619971, 0.9701359068, 1.634198332e-09), y=(-0.2702481501, -0.06756984146, -0.9604167085)), Plane(origin=(-19.30249852, 22.96537422, 19.75001585), x=(-0.6434184522, 0.7655146604, -6.731628033e-10), y=(-0.2132456888, -0.1792339439, -0.9604173413))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])
dominio_x = Domain(dom)
dominio_y = Domain(dom_2)
rectangle = Rectangle(Plane=planos_base, XSize=dominio_x, YSize=dominio_y, Radius=0)  # -> Rectangle, Length
perímetros = Number(rectangle.Length)
rectángulos = Rectangle(rectangle.Rectangle)
