# Grasshopper definition 13-rectangulos-tres-puntos.gh (Grasshopper 1.0.8)

punto_a = Point(Point(14.38923474, 8.151165468, -7.023236843))
punto_c = Point(Point(12.21033256, 32.66487439, 10.22732408))
punto_b = Point(Point(27, 12, 4.477583532))
rec_3pt = Rectangle3Pt(PointA=punto_a, PointB=punto_b, PointC=punto_c)  # -> Rectangle, Length
rectángulo = Rectangle(rec_3pt.Rectangle)
perímetro = Number(rec_3pt.Length)
