# Grasshopper definition 14-rectangulo-dos-puntos.gh (Grasshopper 1.0.8)

planos_base = Plane([Plane(origin=(-26.02883766, 0, 0), x=(0, -1, 0), y=(0, 0, 1)), Plane(origin=(-18.40516746, 0, -18.40516778), x=(-0.7071067873, 0, 0.7071067751), y=(0, 1, 0)), Plane(origin=(0, 0, -26.02883766), x=(-1, 0, 0), y=(0, 1, 0)), Plane(origin=(18.40516778, 0, -18.40516746), x=(0.7071067751, 0, 0.7071067873), y=(0, -1, 0)), Plane(origin=(26.02883766, 0, 0), x=(0, 0, 1), y=(0, -1, 0))])
punto_a = Point(Point(-5.631204291, -9.323555794, 2.626620531))
punto_b = Point(Point(3.055156378, 9.555112851, -2.810507271))
rec_2pt = Rectangle2Pt(Plane=planos_base, PointA=punto_a, PointB=punto_b, Radius=0)  # -> Rectangle, Length
rectángulo = Rectangle(rec_2pt.Rectangle)
perímetro = Number(rec_2pt.Length)
