# Grasshopper definition 15-poligono-plano-radio-lados.gh (Grasshopper 1.0.8)

número_de_lados = Slider(4, range=3..10)
radio = Slider(20.046, range=0..30)
planos_base = Plane([Plane(origin=(55, 0, 0), x=(-1, 0, 0), y=(0, 0, 1)), Plane(origin=(53.03612021, 9.269307615, 0), x=(-0.838763316, -0.3619964129, 0.4067366431), y=(0.3734414885, 0.161171187, 0.9135454576)), Plane(origin=(47.86512961, 17.2398105, 0), x=(-0.4999847841, -0.4446920103, 0.7431448255), y=(0.5552893584, 0.4938805119, 0.6691306064)), Plane(origin=(40.71795374, 23.52866441, 0), x=(-0.177346904, -0.2530604245, 0.9510565163), y=(0.5458176467, 0.7788399025, 0.3090169944)), Plane(origin=(32.44666744, 28.26066314, 0), x=(0.04406925903, 0.09478449262, 0.9945218954), y=(0.4192909916, 0.9018142074, -0.1045284633)), Plane(origin=(23.53043074, 31.63513877, 0), x=(0.1442057581, 0.4787532761, 0.8660254038), y=(0.2497716997, 0.8292249984, -0.5))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])
polygon = Polygon(Plane=planos_base, Radius=radio, Segments=número_de_lados, FilletRadius=0)  # -> Polygon, Length
polígonos = Curve(polygon.Polygon)
perímetro = Number(polygon.Length)
