# Grasshopper definition 16-poligono-arista-plano-lados.gh (Grasshopper 1.0.8)

número_de_lados = Slider(4, range=3..10)
puntos_en_el_plano = Point([Point(-12, -42, 21), Point(-11.25603705, -30.90480551, 18.79939685), Point(-10.64513585, -19.71952337, 17.06366443), Point(-10.17850896, -8.460910789, 15.83113879), Point(-9.867548334, 2.849089247, 15.14060044), Point(-9.723429738, 14.18279315, 15.02988236), Point(-9.756595982, 25.50652284, 15.5340679), Point(-9.976139149, 36.78081195, 16.683354), Point(-10.38913302, 47.961246, 18.50076331), Point(-11, 59, 21)])
inicios_de_arista = Point([Point(-26, -29, 0), Point(-22.65879608, -20.954637, 0), Point(-20.35537876, -12.55153318, 0), Point(-19.04465838, -3.937280737, 0), Point(-18.7489343, 4.770731683, 0), Point(-19.53596008, 13.44721834, 0), Point(-21.4987624, 21.93387232, 0), Point(-24.72467946, 30.02330321, 0), Point(-29.24791657, 37.46367734, 0), Point(-35, 44, 0)])
finales_de_arista = Point([Point(2, -29, 0), Point(0.6237144007, -19.72412119, 0), Point(-0.03187249332, -10.3690947, 0), Point(-0.001701291524, -0.9911758422, 0), Point(0.7465154175, 8.35648123, 0), Point(2.305251496, 17.60258216, 0), Point(4.837115822, 26.62868454, 0), Point(8.592195255, 35.21333507, 0), Point(13.8984227, 42.92468714, 0), Point(21, 49, 0)])
poledge = PolygonEdge(EdgeStart=inicios_de_arista, EdgeEnd=finales_de_arista, PlanePoint=puntos_en_el_plano, Segments=número_de_lados)  # -> Polygon, Centre, CornerRadius, EdgeRadius
polígonos = Curve(poledge.Polygon)
centros = Point(poledge.Centre)
distancia_del_centro_a_vértices = Number(poledge.CornerRadius)
distancia_del_centro_a_aristas = Number(poledge.EdgeRadius)
