# Grasshopper definition 02-interpolar.gh (Grasshopper 1.0.8)

puntos = Point([Point(4.335, 0, 0), Point(4.392140992, 0.9962435788, 0.4258), Point(4.215161166, 2.015917905, 0.8516), Point(3.797136543, 3.003047411, 1.2774), Point(3.144681312, 3.899932855, 1.7032), Point(2.278318568, 4.650445635, 2.129)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])
intcrv = Interpolate(Vertices=puntos, Degree=3, Periodic=False, KnotStyle=1)  # -> Curve, Length, Domain
longitud = Number(intcrv.Length)
curva = Curve(intcrv.Curve)
