# Grasshopper definition 03-nurbs.gh (Grasshopper 1.0.8)

puntos_de_control = Point([Point(0, 0, 0), Point(0, 23.07692308, 16.72223955), Point(0, 46.15384615, -27.76690164), Point(0, 69.23076923, 29.38407441), Point(0, 92.30769231, -21.02469122), Point(0, 115.3846154, 5.526951204), Point(0, 138.4615385, 11.8473134), Point(0, 161.5384615, -25.19914791), Point(0, 184.6153846, 29.9953034), Point(0, 207.6923077, -24.60737691), Point(0, 230.7692308, 10.864691), Point(0, 253.8461538, 6.566802536), Point(0, 276.9230769, -21.76871851), Point(0, 300, 29.57966361)])
nurbs = NurbsCurve(Vertices=puntos_de_control, Degree=3, Periodic=False)  # -> Curve, Length, Domain
curva = Curve(nurbs.Curve)
longitud = Number(nurbs.Length)
