# Grasshopper definition 01-punto-sobre-curva.gh (Grasshopper 1.0.8)

curva = Curve(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)
parámetro_t = Slider(93.35684, range=0..160.96008)
crvdom = CurveDomain(Curve=curva)  # -> Curve, Domain
eval = EvaluateCurve(Curve=curva, Parameter=parámetro_t)  # -> Point, Tangent, Angle
dominio = Panel(crvdom.Domain)
punto_sobre_la_curva = Point(eval.Point)
vector_tangente = Vector(eval.Tangent)
vdisex = VectorDisplayEx(Point=punto_sobre_la_curva, Vector=expr("x*7", vector_tangente), Colour=RGB(0, 217, 255), Width=3)
