# Grasshopper definition 02-plano-perpendicular.gh (Grasshopper 1.0.8)

parámetro_t = Slider(0.246, range=0..1)
curva = Curve(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)
pframe = PerpFrame(Curve=reparameterize(curva), Parameter=parámetro_t)
plano_perpendicular = Plane(pframe)
