# Grasshopper definition 03-curvatura.gh (Grasshopper 1.0.8)

parámetro_t = Slider(0.691, range=0..1)
curva = Curve(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)
frame = CurveFrame(Curve=reparameterize(curva), Parameter=parámetro_t)
curvature = Curvature(Curve=reparameterize(curva), Parameter=parámetro_t)  # -> P, K, C
vector_de_curvatura = Vector(curvature.K)
círculo_de_curvatura = Circle(curvature.C)
plano_de_curvatura = Plane(frame)
vdisex = VectorDisplayEx(Point=curvature.P, Vector=expr("x*500", curvature.K), Colour=RGB(0, 217, 255), Width=3)
