# Grasshopper definition 01-dividir-curva.gh (Grasshopper 1.0.8)

divisiones = Slider(6, range=1..20)
curva = Curve(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)
divide = DivideCurve(Curve=curva, Count=divisiones, Kinks=False)  # -> Points, Tangents, Parameters
puntos = Panel(divide.Points)
vectores_tangentes_en_cada_punto = Panel(divide.Tangents)
vectores_tangentes_en_cada_punto_2 = Panel(divide.Parameters)
