# Grasshopper definition 01-division-segmentos-iguales.gh (Grasshopper 1.0.8)

número_de_divisiones = Slider(12, range=1..20)
# División por puntos
curva = Curve(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)
divide = DivideCurve(Curve=curva, Count=número_de_divisiones, Kinks=False)  # -> Points, Tangents, Parameters
puntos = Point(divide.Points)
vectores_tangentes = Vector(divide.Tangents)
parámetros = Number(divide.Parameters)
número_de_divisiones_2 = Slider(6, range=1..20)
# División por planos
curva_2 = Curve(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)
pframes = PerpFrames(Curve=curva_2, Count=número_de_divisiones_2, Align=True)  # -> Frames, Parameters
planos_perpendiculares = Plane(pframes.Frames)
parámetros_2 = Number(pframes.Parameters)
