# Grasshopper definition 02-division-por-longitud-de-segmentos.gh (Grasshopper 1.0.8)

longitud_de_segmentos = Slider(15, range=1..20)
# División por longitud de segmentos
curva = Curve(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)
divlength = DivideLength(Curve=curva, Length=longitud_de_segmentos)  # -> Points, Tangents, Parameters
puntos = Point(divlength.Points)
vectores_tangentes = Vector(divlength.Tangents)
parámetros = Number(divlength.Parameters)
puntos_2 = Point(puntos)
points = PointList(Points=puntos_2, Size=Slider(2.13, range=0..5))
