# Grasshopper definition armadura-1.gh (Grasshopper 1.0.8)

srf = Surface(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)

# ----
# Parámetros
número_de_divisiones = Integer(Slider(9, range=1..20))
superficie_base = Surface(srf)

# ----
# Coordenadas U
superficie_base_2 = Surface(superficie_base)
número_de_divisiones_2 = Integer(número_de_divisiones)
dedom2 = DeconstructDomain²(Domain=superficie_base_2)  # -> UComponent, VComponent
range = Range(Domain=dedom2.UComponent, Steps=número_de_divisiones_2)
coordenadas_u = Number(range)

# ----
# Curvas sobre la superficie
# Puntos UV
coordenadas_u_2 = Number(coordenadas_u)
pt = ConstructPoint(XCoordinate=coordenadas_u_2, YCoordinate=0, ZCoordinate=0)
puntos_uv = Point(pt)

# ----
# Isocurvas
superficie_base_3 = Surface(superficie_base)
puntos_uv_2 = Point(puntos_uv)
iso = IsoCurve(Surface=superficie_base_3, UVPoint=puntos_uv_2)  # -> UIsocurve, flatten(VIsocurve)
isocurvas = Curve(iso.VIsocurve)

# ----
# Datos de salida
isocurvas_2 = Curve(isocurvas)

# ----
# Parámetros
curva_base = Curve(isocurvas_2)
número_de_divisiones_3 = Integer(Slider(13, range=1..20))

# ----
# Puntos A
número_de_divisiones_4 = Integer(número_de_divisiones_3)
curva_base_2 = Curve(curva_base)
divide = DivideCurve(Curve=curva_base_2, Count=número_de_divisiones_4, Kinks=False)  # -> Points, Tangents, Parameters
puntos_a = Point(divide.Points)

# ----
# Puntos B
puntos_a_2 = Point(puntos_a)
project = Project(Geometry=puntos_a_2, Plane=PlaneXY(0, 0, 0))  # -> Geometry, Transform
puntos_b = Point(project.Geometry)

# ----
# Líneas inferiores
puntos_b_2 = Point(puntos_b)
pline = PolyLine(Vertices=puntos_b_2, Closed=False)
explode = Explode(Curve=pline, Recursive=True)  # -> Segments, Vertices
líneas_inferiores = Line(explode.Segments)

# ----
# Líneas superiores
puntos_a_3 = Point(puntos_a)
pline_2 = PolyLine(Vertices=puntos_a_3, Closed=False)
explode_2 = Explode(Curve=pline_2, Recursive=True)  # -> Segments, Vertices
líneas_superiores = Line(explode_2.Segments)

# ----
# Líneas inclinadas
puntos_a_4 = Point(puntos_a)
lng = ListLength(List=puntos_a_4)
número_de_puntos = Integer(lng)
panel = Panel("""1
0""")
repeat = RepeatData(Data=panel, Length=número_de_puntos)
puntos_a_5 = Point(puntos_a)
puntos_b_3 = Point(puntos_b)
patrón = Integer(repeat)
p_n_c = PickNChoose(Pattern=patrón, Stream0=puntos_a_5, Stream1=puntos_b_3)
puntos_seleccionados = Point(p_n_c)
pline_3 = PolyLine(Vertices=puntos_seleccionados, Closed=False)
explode_3 = Explode(Curve=pline_3, Recursive=True)  # -> Segments, Vertices
líneas_inferiores_2 = Line(explode_3.Segments)

# ----
# Líneas verticales
puntos_a_6 = Point(puntos_a)
puntos_b_4 = Point(puntos_b)
ln = Line(StartPoint=puntos_a_6, EndPoint=puntos_b_4)
# Estructura
líneas_verticales = Line(ln)

# ----
# Datos de salida
líneas_verticales_2 = Line(ln)
líneas_inferiores_3 = Line(explode.Segments)
líneas_inferiores_4 = Line(explode_3.Segments)
líneas_superiores_2 = Line(explode_2.Segments)
