# Grasshopper definition 01-esfera.gh (Grasshopper 1.0.8)

# Esfera desde plano base y radio
number_slider = Slider(18, range=0..50)
plano_base = Plane(PlaneXY(0, 0, 0))
sph = Sphere(Base=plano_base, Radius=number_slider)
esfera = Surface(sph)
