# Grasshopper definition 02-cono.gh (Grasshopper 1.0.8)

longitud = Slider(30.5, range=0..50)
# Cono desde plano base, radio y longitud
radio = Slider(13, range=0..50)
plano_base = Plane(Plane(origin=(0, 0, 0), x=(0.954479978, 0.2982749931, 0), y=(-0.2829685042, 0.9054992135, 0.316227766)))
cone = Cone(Base=plano_base, Radius=radio, Length=longitud)  # -> Cone, Tip
cono = Surface(cone.Cone)
punta = Point(cone.Tip)
