# Grasshopper definition 03-cilindro.gh (Grasshopper 1.0.8)

longitud = Slider(13, range=0..50)
# Cilindro desde plano base, radio y longitud
radio = Slider(15.5, range=0..50)
plano_base = Plane(Plane(origin=(12, 5, 0), x=(0.4856429312, -0.8741572761, 0), y=(0.8215272592, 0.4564040329, 0.3417430631)))
cyl = Cylinder(Base=plano_base, Radius=radio, Length=longitud)
cilindro = Surface(cyl)
