# Grasshopper definition 04-caja-centro.gh (Grasshopper 1.0.8)

# Caja desde plano base y dimensiones X, Y y Z
dimensión_x = Slider(4.671, range=0..10)
dimensión_y = Slider(1.416, range=0..10)
dimensión_y_2 = Number([8.328431822, 13.7177304, 18.61957658, 20.82695827, 19.1977531, 14.5828855, 9.128618101, 4.709069717])
plano_base = Plane([PlaneXY(0, 0, 0), PlaneXY(0, 0, 4.714285714), PlaneXY(0, 0, 9.428571429), PlaneXY(0, 0, 14.14285714), PlaneXY(0, 0, 18.85714286), PlaneXY(0, 0, 23.57142857), PlaneXY(0, 0, 28.28571429), PlaneXY(0, 0, 33)])
box = CenterBox(Base=plano_base, X=dimensión_x, Y=dimensión_y_2, Z=dimensión_y)
cajas = Box(box)
