# Grasshopper definition 05-caja-delimitadora.gh (Grasshopper 1.0.8)

plano_base = Plane(Plane(origin=(0, 0, 0), x=(0.9397934235, 0.3417430631, 0), y=(-0.3278565051, 0.9016053891, -0.282166324)))
# Caja delimitadora
geometría = Geometry([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])
bbox = BoundingBox(Content=geometría, Plane=plano_base, UnionBox=True)  # -> Box, Box_2
caja_delimitadora = Box(bbox.Box)
