# Grasshopper definition 06-superficie-plana.gh (Grasshopper 1.0.8)

# Superficie plana
plano_base = Plane([Plane(origin=(27.04784259, -0.3250056894, 47.88700639), x=(-0.4196939164, -0.6781727074, -0.6032734003), y=(-0.5706610597, -0.3196999743, 0.7563979649)), Plane(origin=(20.47088074, 5.482902308, 45.37843828), x=(-0.3640107467, -0.7271917885, -0.581969311), y=(-0.570928381, -0.3194695072, 0.7562936056)), Plane(origin=(13.60219237, 10.68866409, 42.38423131), x=(-0.2838502363, -0.7876219779, -0.5468826779), y=(-0.5721565679, -0.3185544445, 0.755751234)), Plane(origin=(6.426772671, 14.97288909, 38.73517867), x=(-0.1620330949, -0.859604986, -0.4845869831), y=(-0.5756478481, -0.3165195131, 0.753952885)), Plane(origin=(-0.9652371176, 17.76395061, 34.20667186), x=(0.02849445164, -0.9297815853, -0.3670071796), y=(-0.584514728, -0.3133400582, 0.7484387354)), Plane(origin=(-8.131904592, 18.15370266, 28.64074145), x=(0.2982805096, -0.9416433732, -0.1560015873), y=(-0.6040163235, -0.3127729806, 0.7330329758))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])
dominio_x = Domain(Domain(0, 3))
dominio_y = Domain(Domain(0, 10))
planesrf = PlaneSurface(Plane=plano_base, XSize=dominio_x, YSize=dominio_y)
superficies_planas = Surface(planesrf)
