# Grasshopper definition desmoldeo.gh (Grasshopper 1.0.8)

srf = Surface(<surface referenced from the Rhino model>)
mesh_uv = MeshSurface(Surface=srf, UCount=Slider(60, range=1..100), VCount=Slider(60, range=1..100), Overhang=True, Equalize=False)
mesh = MeshBrep(
    Brep=srf,
    Settings={GridMaxCount=0, GridMinCount=16, JaggedSeams=False, MaxEdgeLength=0, MinEdgeLength=0.0001, MinTolerance=0, Refine=True, RefineAngle=0, RelativeTolerance=0.65, SimplePlanes=True, Tolerance=0})
number_slider = Slider(0.701, range=0..20)
demesh = DeconstructMesh(Mesh=mesh_uv)  # -> Vertices, Faces, Colours, Normals
Z = UnitZ(Factor=number_slider)
amp = Amplitude(Vector=demesh.Normals, Amplitude=number_slider)
vdis = VectorDisplay(Anchor=demesh.Vertices, Vector=Z)
Z_2 = UnitZ(Factor=1)
vdis_2 = VectorDisplay(Anchor=demesh.Vertices, Vector=amp)
angle = Angle(VectorA=demesh.Normals, VectorB=Z_2)  # -> Angle, Reflex
deg = Degrees(Radians=angle.Angle)
tag = TextTag(Location=demesh.Vertices, Text=deg)
gradient = Gradient(LowerLimit="0", UpperLimit="90", Parameter=deg, stops=[0: RGB(0, 128, 0), 0.536: RGB(255, 255, 0), 1: RGB(255, 0, 0)])
conmesh = ConstructMesh(Vertices=demesh.Vertices, Faces=demesh.Faces, Colours=gradient)
