# Grasshopper definition estructura.gh (Grasshopper 1.0.8)
# plug-ins: PTComponentLibrary

divisiones_u = Slider(2, range=1..30)
divisiones_v = Slider(3, range=1..30)
superficie_base = Surface(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)

# ----
# Parámetros
superficie_base_2 = Surface(superficie_base)
divisiones_u_2 = Integer(divisiones_u)
divisiones_v_2 = Integer(divisiones_v)
altura = Number(Slider(12, range=0..20))

# ----
# Puntos P
superficie_base_3 = Surface(superficie_base_2)
divisiones_u_3 = Integer(divisiones_u_2)
divisiones_v_3 = Integer(divisiones_v_2)
sdivide = DivideSurface(Surface=superficie_base_3, UCount=divisiones_u_3, VCount=divisiones_v_3)  # -> simplify(Points), Normals, Parameters
puntos_p = Point(sdivide.Points)

# ----
# Agrupar puntos P
puntos_p_2 = Point(puntos_p)
panel = Panel("""{+0;+0}
{+0;+1}
{+1;+1}
{+1;+0}""")
graft = GraftTree(Tree=puntos_p_2, IncludeEmptyLists=True, IncludeNullItems=True)
relitem = RelativeItem(Tree=graft, Offset=panel, WrapPaths=False, WrapItems=False)  # -> ItemA, ItemB
prune = PruneTree(Tree=relitem.ItemB, Minimum="4", Maximum="4")
puntos_p_3 = Point(prune)

# ----
# Puntos Q
puntos_p_4 = Point(puntos_p_3)
superficie_base_4 = Surface(superficie_base_2)
avr = Average(Input=puntos_p_4)
srf_cp = SurfaceClosestPoint(Point=avr, Surface=superficie_base_4)  # -> Point, UVPoint, Distance
evalsrf = EvaluateSurface(Surface=superficie_base_4, Point=srf_cp.UVPoint)  # -> Point, Normal, UDirection, VDirection, Frame
altura_2 = Number(altura)
amp = Amplitude(Vector=evalsrf.Normal, Amplitude=expr("-x", altura_2))
move = Move(Geometry=avr, Motion=amp)  # -> Geometry, Transform
puntos_q = Point(move.Geometry)

# ----
# Líneas A
puntos_p_5 = Point(puntos_p)
pline = PolyLine(Vertices=puntos_p_5, Closed=False)
explode = Explode(Curve=pline, Recursive=True)  # -> simplify(Segments), Vertices
líneas_a = Line(explode.Segments)

# ----
# Líneas B
puntos_p_6 = Point(puntos_p)
flip = FlipMatrix(Data=puntos_p_6)
pline_2 = PolyLine(Vertices=flip, Closed=False)
explode_2 = Explode(Curve=pline_2, Recursive=True)  # -> simplify(Segments), Vertices
líneas_b = Line(explode_2.Segments)

# ----
# Líneas D
puntos_q_2 = Point(puntos_q)
trim = TrimTree(Tree=puntos_q_2, Depth=1)
pline_3 = PolyLine(Vertices=trim, Closed=False)
explode_3 = Explode(Curve=pline_3, Recursive=True)  # -> simplify(Segments), Vertices
líneas_d = Line(explode_3.Segments)

# ----
# Líneas C
puntos_q_3 = Point(puntos_q)
puntos_p_7 = Point(puntos_p_3)
ln = Line(StartPoint=puntos_p_7, EndPoint=puntos_q_3)
líneas_c = Line(ln)

puntos_p_8 = Point(puntos_p)
ptcell = Cellulate(Grid=puntos_p_8)  # -> Wires, Cells, Meshes
tstat = TreeStatistics(Tree=puntos_p_8)  # -> graft(Paths), Length, Count
series = Series(Start=0, Step=1, Count=tstat.Length)
avr_2 = Average(Input=ptcell.Cells)  # -> simplify(ArithmeticMean)
Z = UnitZ(Factor=Slider(3, range=0..10))
format = Format(Format="{0}[{1}]", Culture=127, Data0=tstat.Paths, Data1=series)
move_2 = Move(Geometry=puntos_p_8, Motion=Z)  # -> Geometry, Transform
tag = TextTag(Location=move_2.Geometry, Text=format)
puntos_p_9 = Point(graft(puntos_p_8))
tstat_2 = TreeStatistics(Tree=puntos_p_9)  # -> Paths, Length, Count
panel_2 = Panel(tstat_2.Paths)
Y = UnitY(Factor=Slider(2, range=0..10))
Z_2 = UnitZ(Factor=Slider(3, range=0..10))
unflatten = UnflattenTree(Tree=tstat_2.Paths, Guide=puntos_p_9)
move_3 = Move(Geometry=puntos_p_9, Motion=Y)  # -> Geometry, Transform
panel_3 = Panel(unflatten)
tag_2 = TextTag(Location=move_3.Geometry, Text=unflatten)
panel_4 = Panel(puntos_p_9)
