# Grasshopper definition 01-cilindro.gh (Grasshopper 1.0.8)

radio = Slider(8.486, range=0..10)
longitud = Slider(6.9, range=0..10)
radio_2 = Number(radio)
longitud_2 = Number(longitud)
cir = Circle(Plane=PlaneXY(0, 0, 0), Radius=radio_2)
Z = UnitZ(Factor=longitud_2)
extr = Extrude(Base=cir, Direction=Z)
