# Grasshopper definition toroide.gh (Grasshopper 1.0.8)

radio_exterior = Slider(15, range=0..20)
radio_interior = Slider(5.4, range=0..20)
radio_exterior_2 = Number(radio_exterior)
radio_interior_2 = Number(radio_interior)
radio_exterior_3 = Number(radio_exterior_2)
radio_interior_3 = Number(radio_interior_2)
radio_exterior_4 = Number(radio_exterior_2)
radio_interior_4 = Number(radio_interior_2)
# Centro de la sección
expression = Expression(x=radio_interior_3, y=radio_exterior_3, Expression="(x + y) / 2")
# Radio de la sección
expression_2 = Expression(x=radio_interior_4, y=radio_exterior_4, Expression="(x - y) / 2")
x_centro = Number(expression)
radio_de_la_sección = Number(expression_2)
pt = ConstructPoint(XCoordinate=x_centro, YCoordinate=0, ZCoordinate=0)
panel = Panel(radio_de_la_sección)
centro = Point(pt)
centro_2 = Point(centro)
radio_de_la_sección_2 = Number(radio_de_la_sección)
xz = XZPlane(Origin=centro_2)
# Sección
cir = Circle(Plane=xz, Radius=radio_de_la_sección_2)
sección = Circle(cir)
# Arreglo polar de secciones
sección_2 = Circle(sección)
arrpolar = PolarArray(Geometry=sección_2, Plane=PlaneXY(0, 0, 0), Count=10, Angle=6.283185307)  # -> Geometry, Transform
secciones = Curve(arrpolar.Geometry)
superficie_cerrada = BooleanToggle(True)
loft_opt = LoftOptions(Closed=superficie_cerrada, Adjust=False, Rebuild=0, Refit=0, Type=0)
secciones_2 = Curve(secciones)
# Toroide
loft = Loft(Curves=secciones_2, Options=loft_opt)
toroide = Surface(loft)
