# Grasshopper definition graph-mapper.gh (Grasshopper 1.0.8)

número_de_círculos = Slider(10, range=1..30)
altura = Slider(14.5, range=0..50)
altura_2 = Number(altura)
número_de_círculos_2 = Integer(número_de_círculos)
número_de_círculos_3 = Integer(número_de_círculos_2)
expression = Expression(x=número_de_círculos_3, Expression="x - 1")
número_de_divisiones = Integer(expression)
número_de_divisiones_2 = Integer(número_de_divisiones)
altura_3 = Number(altura_2)
número_de_divisiones_3 = Integer(número_de_divisiones)
# Coordenada Z de los centros
# de los círculos
dom = ConstructDomain(DomainStart=0, DomainEnd=altura_3)
# Radios
range = Range(Domain=Domain(0, 1), Steps=número_de_divisiones_2)
panel = Panel(range)
range_2 = Range(Domain=dom, Steps=número_de_divisiones_3)
graph = GraphMapper(
    range,
    x0=0,
    x1=1,
    y0=0,
    y1=30,
    container_name="Bezier",
    cpx=[0, 0.3478260934, 0.6956521869, 1],
    cpy=[0.2753623128, 0.8913043737, 0.1594203115, 0.3550724387])
z_centros = Number(range_2)
panel_2 = Panel(z_centros)
radios = Number(graph)
z_centros_2 = Number(z_centros)
# Círculos
pt = ConstructPoint(XCoordinate=0, YCoordinate=0, ZCoordinate=z_centros_2)
centros = Point(pt)
radios_2 = Number(radios)
cir = Circle(Plane=centros, Radius=radios_2)
círculos = Circle(cir)
círculos_2 = Circle(círculos)
# Superficie
loft = Loft(Curves=círculos_2, Options={Adjust=False, Closed=False, LoftEnds=0, LoftSimp=0, LoftType=0, Rebuild=10, Refit=0.01})
superficie = Surface(loft)
