# Grasshopper definition atractores.gh (Grasshopper 1.0.8)

número_de_columnas = Slider(42, range=1..50)
número_de_filas = Slider(30, range=1..50)
radio_de_celdas = Slider(1.4, range=0..5)
radio_menor = Slider(0.1, range=0..5)
radio_mayor = Slider(1.192, range=0..5)
atractores = Point([Point(10, 25, 0), Point(74, 63, 0)])

# ----
# Parámetros de
# distribución de círculos
número_de_columnas_2 = Integer(número_de_columnas)
número_de_filas_2 = Integer(número_de_filas)
radio_de_celdas_2 = Number(radio_de_celdas)

# ----
# Parámetros del patrón
radio_menor_2 = Number(radio_menor)
radio_mayor_2 = Number(radio_mayor)
atractores_2 = Point(atractores)

# ----
# Rejilla hexagonal
número_de_columnas_3 = Integer(número_de_columnas_2)
número_de_filas_3 = Integer(número_de_filas_2)
radio_de_celdas_3 = Number(radio_de_celdas_2)
hexgrid = Hexagonal(Plane=PlaneXY(0, 0, 0), Size=radio_de_celdas_3, ExtentX=número_de_columnas_3, ExtentY=número_de_filas_3)  # -> Cells, flatten(Points)
centros = Point(hexgrid.Points)

# ----
# Distancia a atractor
atractores_3 = Point(atractores_2)
centros_2 = Point(centros)
cp = ClosestPoint(Point=centros_2, Cloud=atractores_3)  # -> ClosestPoint, CPIndex, Distance
distancia_a_atractor = Number(cp.Distance)

# ----
# Dominio de distancias
distancia_a_atractor_2 = Number(distancia_a_atractor)
bnd = Bounds(Numbers=distancia_a_atractor_2)
dominio_de_distancias = Domain(bnd)

# ----
# Dominio de radios
radio_menor_3 = Number(radio_menor_2)
radio_mayor_3 = Number(radio_mayor_2)
dom = ConstructDomain(DomainStart=radio_menor_3, DomainEnd=radio_mayor_3)
dominio_de_radios = Domain(dom)

# ----
# Cálculo de radios
dominio_de_distancias_2 = Domain(dominio_de_distancias)
distancia_a_atractor_3 = Number(distancia_a_atractor)
dominio_de_radios_2 = Domain(dominio_de_radios)
remap = RemapNumbers(Value=distancia_a_atractor_3, Source=dominio_de_distancias_2, Target=dominio_de_radios_2)  # -> Mapped, Clipped
radios = Number(remap.Mapped)

# ----
# Patrón de círculos
radios_2 = Number(radios)
centros_3 = Point(centros)
cir = Circle(Plane=centros_3, Radius=radios_2)
círculos = Circle(cir)
