# Grasshopper definition box-morph-00.gh (Grasshopper 1.0.8)

subd = SubD(<subd referenced from the Rhino model>)
meshsubd = MeshFromSubD(SubD=subd, Density=2)
srf = Surface(<surface referenced from the Rhino model>)
bbox = BoundingBox(Content=meshsubd, Plane=PlaneXY(0, 0, 0))  # -> Box, Box_2
divide = DivideDomain²(Domain=srf, UCount=Slider(50, range=1..50), VCount=Slider(25, range=1..50))
sbox = SurfaceBox(Surface=srf, Domain=divide, Height=Slider(3, range=0..10))
morph = BoxMorph(Geometry=meshsubd, Reference=bbox.Box, Target=sbox)
mjoin = MeshJoin(Meshes=morph)
