# Grasshopper definition box-morph.gh (Grasshopper 1.0.8)
# plug-ins: Pufferfish

repeticiones_u = Slider(7, range=1..50)
repeticiones_v = Slider(7, range=1..50)
relieve = Slider(6.6, range=0..10)

superfice_simple = Surface(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)
otra_superficie = Surface(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)
otra_superficie_2 = Surface(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)
toroide = Surface(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)

patrón = SubD(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)
superficie_base = Surface(superfice_simple)
patrón_2 = Geometry(patrón)
repeticiones_u_2 = Integer(repeticiones_u)
repeticiones_v_2 = Integer(repeticiones_v)
relieve_2 = Number(relieve)
# División de la superficie
superficie_base_2 = Surface(superficie_base)
repeticiones_u_3 = Integer(repeticiones_u_2)
repeticiones_v_3 = Integer(repeticiones_v_2)
dominio_uv = Domain²(superficie_base_2)
dominio_uv_2 = Panel(dominio_uv)
divide = DivideDomain²(Domain=dominio_uv, UCount=repeticiones_u_3, VCount=repeticiones_v_3)
segmentos_uv = Domain²(divide)
divisiones_del_dominio_uv = Panel(segmentos_uv)
superficie_base_3 = Surface(superficie_base)
segmentos_uv_2 = Domain²(segmentos_uv)
# Caja de referencia
patrón_3 = Geometry(patrón_2)
relieve_3 = Number(relieve_2)
bbox = BoundingBox(Content=patrón_3, Plane=PlaneXY(0, 0, 0))  # -> Box, Box_2
# Cajas UV
sbox = SurfaceBox(Surface=superficie_base_3, Domain=segmentos_uv_2, Height=relieve_3)
caja_referencia = Box(bbox.Box)
cajas_uv = TwistedBox(sbox)
caja_referencia_2 = Box(caja_referencia)
cajas_uv_2 = TwistedBox(cajas_uv)
# Repetición del patrón
patrón_4 = Geometry(patrón_2)
morph = BoxMorph(Geometry=patrón_4, Reference=caja_referencia_2, Target=cajas_uv_2)
patrón_repetido = SubD(morph)
patrón_repetido_2 = SubD(patrón_repetido)
# Unir y cerrar la superfice
subdpoly = SubDControlPolygon(SubD=patrón_repetido_2)
mjoin = MeshJoin(Meshes=subdpoly)
rebmsh = RebuildMesh(
    Mesh=mjoin,
    RebuildNormals=True,
    CullUnused=True,
    UnifyNormals=True,
    FlipNormals=False,
    IdenticalCombine=True,
    WeldVertices=0)
clsmsh = CloseMesh(Mesh=rebmsh, Quadrangulate=True)  # -> Closed, Amount, Openings, R
subdmesh = SubDFromMesh(Mesh=clsmsh.Closed, Creases=1, Corners=1, Interpolate=False)
figura_cerrada = SubD(subdmesh)
