# Grasshopper definition armadura-1-00.gh (Grasshopper 1.0.8)
# plug-ins: Kangaroo2 Components

range = Range(Domain=Domain(0, 1), Steps=Slider(5, range=1..20))
srf = Surface(<surface referenced from the Rhino model>)
pt = ConstructPoint(XCoordinate=range, YCoordinate=0, ZCoordinate=0)
iso = IsoCurve(Surface=reparameterize(srf), UVPoint=pt)  # -> UIsocurve, flatten(VIsocurve)
crv = Curve(iso.VIsocurve)
line = Line(Line((0, -15, 5), (0, 35, 15)))
xy = XYPlane(Origin=Point(0, 0, 0))
crv_2 = Curve(line)
pln = Plane(xy)
divide = DivideCurve(Curve=crv_2, Count=Slider(4, range=1..20), Kinks=False)  # -> Points, Tangents, Parameters
lng = ListLength(List=divide.Points)
project = Project(Geometry=divide.Points, Plane=pln)  # -> Geometry, Transform
series = Series(Start=0, Step=1, Count=lng)
pline = PolyLine(Vertices=divide.Points, Closed=False)
ln = Line(StartPoint=project.Geometry, EndPoint=divide.Points)
pline_2 = PolyLine(Vertices=project.Geometry, Closed=False)
format = Format(Format="A{0}", Culture=127, Data0=series)
pt_2 = Point(project.Geometry)
pt_3 = Point(divide.Points)
panel = Panel("""0
1""")
tag = TextTag(Location=divide.Points, Text=format)
lng_2 = ListLength(List=pt_2)
repeat = RepeatData(Data=panel, Length=lng_2)
p_n_c = PickNChoose(Pattern=repeat, Stream0=pt_2, Stream1=pt_3)
pline_3 = PolyLine(Vertices=p_n_c, Closed=False)
merge = Merge(Data1=pline, Data2=ln, Data3=pline_2, Data4=pline_3)  # -> flatten(Result)
explode = Explode(Curve=merge, Recursive=True)  # -> flatten(Segments), Vertices
mp = MultiPipe(
    Curves=explode.Segments,
    NodeSize=Slider(0.271, range=0..10),
    EndOffset=Slider(0.14, range=0..10),
    StrutSize=Slider(0.758, range=0..10),
    Segment=Slider(0.344, range=0..5),
    KinkAngle=0.6,
    CubeFit=0,
    Caps=0)  # disabled
