# Grasshopper definition armadura-1.gh (Grasshopper 1.0.8)

xy = XYPlane(Origin=Point(0, 0, 0))
line = Line(Line((0, -26, 21), (0, 59, 17)))

# ----
# Parámetros
curva_base = Curve(line)
número_de_divisiones = Integer(Slider(5, range=1..20))
plano_base = Plane(xy)

# ----
# Puntos superiores
número_de_divisiones_2 = Integer(número_de_divisiones)
curva_base_2 = Curve(curva_base)
divide = DivideCurve(Curve=curva_base_2, Count=número_de_divisiones_2, Kinks=False)  # -> Points, Tangents, Parameters
puntos_superiores = Point(divide.Points)

# ----
# Puntos inferiores
puntos_superiores_2 = Point(puntos_superiores)
plano_base_2 = Plane(plano_base)
project = Project(Geometry=puntos_superiores_2, Plane=plano_base_2)  # -> Geometry, Transform
puntos_inferiores = Point(project.Geometry)

# ----
# Líneas verticales
puntos_superiores_3 = Point(puntos_superiores)
puntos_inferiores_2 = Point(puntos_inferiores)
ln = Line(StartPoint=puntos_inferiores_2, EndPoint=puntos_superiores_3)
líneas_verticales = Line(ln)
